# Grasshopper definition 03. VK_DaylightMetrics_script.gh (Grasshopper 1.0.7)
# Copyright: Tegnestuen Vandkunsten
# plug-ins: Human, Ironbug, MetaHopper, Bifocals, Ironbug.LBHB_Legacy, LunchBox, EleFront

# ----
# Project
name_of_project = Panel("Indsæt Projektnavn")
# INPUT
image = ImageSampler(Filter="Colour", Interpolate=False, Umax=1, Umin=0, Vmax=1, Vmin=0, Wrap=0)
docinfo = GhPythonScript()  # -> out, version, fileName, filePath, dateCreated, author, dateUpdated, description
# ---------- docinfo: Python ----------
__author__ = "ibc"
__version__ = "2020.10.07"

import rhinoscriptsyntax as rs
import Grasshopper as gh
import Grasshopper.CentralSettings as settings
import time

version = gh.Versioning.Version
fileName = ghdoc.Name
filePath = ghdoc.Path
dateCreated = ghenv.Component.OnPingDocument().Properties.Date
author = settings.AuthorName
dateUpdated = time.strftime("%m/%d/%Y %H:%M:%S")
description = ghenv.Component.OnPingDocument().Properties.Description
# ---------- end docinfo ----------
docinfo_2 = DocumentInfo(AutoUpdate=False, Recursive=False)  # -> DocumentName, DocumentFilePath, Components, Params, _3rdPartyAssemblies
panel = Panel([docinfo.version, docinfo.fileName, docinfo.filePath, docinfo.dateCreated, docinfo.author, docinfo.dateUpdated, docinfo.description, docinfo_2._3rdPartyAssemblies])

# ---- group: Windows
simlay = CreatesSimLayers(bool=Toggle(False))
cluster = Cluster_8(i=0)
cluster_2 = Cluster_9()  # -> floor_2, ceiling_2, walls_2

# ---- group: Customize Canvas
customize_canvas = CSharpScript(
    switcher=Toggle(True),
    canvas_back=ColourSwatch(SwatchColor=RGB(221, 235, 211)),
    canvas_grid=ColourSwatch(SwatchColor=RGB(255, 255, 255)))  # -> out, A; inputs switcher: Boolean, canvas_back: Color, canvas_grid: Color
# ---------- customize_canvas: C# usings ----------
using System.IO;
using System.Linq;
using System.Data;
using System.Drawing;
using System.Reflection;
using System.Windows.Forms;
using System.Xml;
using System.Xml.Linq;
using System.Runtime.InteropServices;

using Rhino.DocObjects;
using Rhino.Collections;
using GH_IO;
using GH_IO.Serialization;
# ---------- customize_canvas: C# ----------
    //Code found on http://james-ramsden.com/change-the-colour-of-the-grasshopper-canvas/ and was developed by Johannes Braumann
    //Thank you to the makers of this code and for making it open-source
    
    if (switcher == true)
    {
      Grasshopper.GUI.Canvas.GH_Skin.canvas_grid = canvas_grid;
      Grasshopper.GUI.Canvas.GH_Skin.canvas_back = canvas_back;
      Grasshopper.GUI.Canvas.GH_Skin.canvas_edge = Color.FromArgb(255, 0, 0, 0);
      Grasshopper.GUI.Canvas.GH_Skin.canvas_shade = Color.FromArgb(80, 0, 0, 0);
    }
    else
    {
      //DEFAULTS
      Grasshopper.GUI.Canvas.GH_Skin.canvas_grid = Color.FromArgb(30, 0, 0, 0);
      Grasshopper.GUI.Canvas.GH_Skin.canvas_back = Color.FromArgb(255, 212, 208, 200);
      Grasshopper.GUI.Canvas.GH_Skin.canvas_edge = Color.FromArgb(255, 0, 0, 0);
      Grasshopper.GUI.Canvas.GH_Skin.canvas_shade = Color.FromArgb(80, 0, 0, 0);
    }
# ---------- end customize_canvas ----------

# ----
# Daylight-model
toggle = FalseStartToggle(False)
toggle_2 = FalseStartToggle(True)
hideshow = HideShowObjectPreview(
    Visible=toggle,
    AllObjects_Object=[model, assigngridsviews, panel_53, reflectane_transparency_5, panel_7, reflectane_transparency_7, panel_6, opaquemod_6, shade, reflectane_transparency_6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])
wiredisplay = ControlWireDisplay(
    WireDisplay=Slider(2, range=0..2),
    AllObjects_Object=[model, assigngridsviews, panel_53, reflectane_transparency_5, panel_7, reflectane_transparency_7, panel_6, opaquemod_6, shade, reflectane_transparency_6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])
onoff = EnableDisableObject(
    Enabled=toggle_2,
    AllObjects_Object=[model, assigngridsviews, panel_53, reflectane_transparency_5, panel_7, reflectane_transparency_7, panel_6, opaquemod_6, shade, reflectane_transparency_6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])

# ----
# FUNCTIONAL UNITS
# 01) Daylight
# A) Set up materials and geometries
referencesensorlayer = Panel("0_daylight::0_sensor")
filterbasedongeometry = Panel("""surface
brep
curve""")
central_sim_switch = FalseStartToggle(False)
run_room = Slider(1, range=0..4)

# ----
# Opaque Materials
panel_2 = Panel("wall")
panel_3 = Panel("ceiling")
panel_4 = Panel("frames")
panel_5 = Panel("floor")
reflectane_transparency = ValueList({"0", "1", "2", "3", "4", "5", "6", "7", "8", "9"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}, selected="50")
reflectane_transparency_2 = ValueList({"0", "1", "2", "3", "4", "5", "6", "7", "8", "9"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}, selected="70")
reflectane_transparency_3 = ValueList({"0", "1", "2", "3", "4", "5", "6", "7", "8", "9"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}, selected="20")
reflectane_transparency_4 = ValueList({"0", "1", "2", "3", "4", "5", "6", "7", "8", "9"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}, selected="70")
cluster_3 = Cluster_2(B=panel_5, C=reflectane_transparency_3)  # -> T, txt_4, txt_5
cluster_4 = Cluster_2(B=panel_4, C=reflectane_transparency_4)  # -> T, txt_4, txt_5
cluster_5 = Cluster_2(B=panel_2, C=reflectane_transparency)  # -> T, txt_4, txt_5
cluster_6 = Cluster_2(B=panel_3, C=reflectane_transparency_2)  # -> T, txt_4, txt_5
opaquemod = HBOpaqueModifier(name=cluster_5.txt_4, reflect=cluster_5.txt_5)  # -> modifier; plug-in component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
opaquemod_2 = HBOpaqueModifier(name=cluster_6.txt_4, reflect=cluster_6.txt_5)  # -> modifier; plug-in component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
opaquemod_3 = HBOpaqueModifier(name=cluster_3.txt_4, reflect=cluster_3.txt_5)  # -> modifier; plug-in component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
opaquemod_4 = HBOpaqueModifier(name=cluster_4.txt_4, reflect=cluster_4.txt_5)  # -> modifier; plug-in component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
face = HBFace(geo=cluster_4.T, name=cluster_4.txt_4, rad_mod=opaquemod_4)  # -> report, faces; plug-in component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
face_2 = HBFace(geo=cluster_6.T, name=cluster_6.txt_4, rad_mod=opaquemod_2)  # -> report, faces; plug-in component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
face_3 = HBFace(geo=cluster_3.T, name=cluster_3.txt_4, rad_mod=opaquemod_3)  # -> report, faces; plug-in component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
face_4 = HBFace(geo=cluster_5.T, name=cluster_5.txt_4, rad_mod=opaquemod)  # -> report, faces; plug-in component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
data = Data([face_4.faces, face_2.faces, face_3.faces, face.faces])
clean = CleanTree(RemoveNulls=True, RemoveInvalid=True, RemoveEmpty=True, Tree=data)

# ----
# Shading
panel_6 = Panel("terrain")
panel_7 = Panel("context")
reflectane_transparency_5 = ValueList({"0", "1", "2", "3", "4", "5", "6", "7", "8", "9"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}, selected="20")
reflectane_transparency_6 = ValueList({"0", "1", "2", "3", "4", "5", "6", "7", "8", "9"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}, selected="10")
reflectane_transparency_7 = ValueList({"0", "1", "2", "3", "4", "5", "6", "7", "8", "9"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}, selected="10")
cluster_7 = Cluster_2(B=panel_7, C=reflectane_transparency_5)  # -> T, txt_4, txt_5
cluster_8 = Cluster_2(B=panel_6, C=reflectane_transparency_7)  # -> T, txt_4, txt_5
opaquemod_5 = HBOpaqueModifier(name=cluster_7.txt_4, reflect=cluster_7.txt_5)  # -> modifier; plug-in component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
opaquemod_6 = HBOpaqueModifier(name=cluster_8.txt_4, reflect=cluster_8.txt_5)  # -> modifier; plug-in component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
shade = HBShade(geo=cluster_8.T, name=cluster_8.txt_4, rad_mod=opaquemod_6)  # -> report, shades; plug-in component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
shade_2 = HBShade(geo=cluster_7.T, name=cluster_7.txt_4, rad_mod=opaquemod_5)  # -> report, shades; plug-in component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
data_2 = Data([shade.shades, shade_2.shades])
clean_2 = CleanTree(RemoveNulls=True, RemoveInvalid=True, RemoveEmpty=True, Tree=data_2)

# ----
# Apertures/Glazing
panel_8 = Panel("window")
reflectane_transparency_8 = ValueList({"0", "1", "2", "3", "4", "5", "6", "7", "8", "9"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}, selected="72")
reflectane_transparency_9 = ValueList({"0", "1", "2", "3", "4", "5", "6", "7", "8", "9"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}, selected="88")
cluster_9 = Cluster_2(B=panel_8, C=reflectane_transparency_8)  # -> T, txt_4, txt_5
glassmod = HBGlassModifier(name=cluster_9.txt_4, trans=cluster_9.txt_5)  # -> modifier; plug-in component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
aperture = HBAperture(geo=cluster_9.T, name=cluster_9.txt_4, rad_mod=glassmod)  # -> report, apertures; plug-in component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
clean_3 = CleanTree(RemoveNulls=True, RemoveInvalid=True, RemoveEmpty=True, Tree=aperture.apertures)

run_cycle_plug_in = Button()

# ----
# Sensor Surfaces
dpipeline = DynamicGeometryPipeline(
    LayerFilter=graft(referencesensorlayer),
    TypeFilter=filterbasedongeometry,
    NameFilter="*",
    GroupByLayer=False,
    GroupByType=False,
    IncludeHidden=True,
    IncludeLocked=True,
    enableFullPath=True,
    listenToAttributes=True)  # -> flatten(GeometryOut)
lng = ListLength(List=dpipeline)
panel_9 = Panel("if (x>0,True,False)")
# CONTROL WIRES + TURN GROUP ON/OFF
fly = Ladybug_fly(fly=run_cycle_plug_in)  # -> Vviiiiiiiiiizzz; inputs inputSliders: list, fly: Boolean; plug-in component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
panel_10 = Panel(lng)
item = ListItem(List=dpipeline, Index=run_room, Wrap=True)
eval = Evaluate(F=panel_9, x=panel_10)

panel_11 = Panel(cluster_7.txt_4)

analysis_mesh_spacing_br18_or_ds_en_1703 = ValueList({"BR18": 0, "DS/EN 17037": 1, "Custom": 2}, selected="Custom")  # "Analysis Mesh Spacing (BR18 or DS/EN 17037)"
flipnormals = ValueList({"No Flip": "0", "Flip": "1"}, selected="No Flip")
analysis_mesh_spacing_max_500mm_in_dk = Panel("2000")

distance_from_analysis_surface = ValueList({"0 mm (No offset)": "0mm", "10 mm (Outdoor)": "10mm", "500 mm (BR18 Residential)": "500mm", "550 mm": "550mm", "700 mm": "700mm", "800 mm": "800mm", "850 mm (BR15 + BR18 Office)": "850mm"}, selected="500 mm (BR18 Residential)")
# Analysis Grid
boundary_offset = ValueList({"No offset": "0mm", "BR18 offset (500mm)": "500mm"}, selected="BR18 offset (500mm)")

toggle_3 = FalseStartToggle(False)
toggle_4 = FalseStartToggle(True)
wiredisplay_2 = ControlWireDisplay(
    WireDisplay=Slider(2, range=0..2),
    AllObjects_Object=[max_analysis_mesh_spacing_ds_en_17037, grid_ds_en_17037, distance_from_analysis_surface, distance_from_surface, U, U_2, dpipeline, referencesensorlayer, filterbasedongeometry, analysis_mesh_spacing_max_500mm_in_dk, boundary_offset, docunits_5, boundary_offset_2, panel_54, analysis_mesh_spacing_br18_or_ds_en_1703, python, fly, lng, panel_10, run_room, sensorgrid, central_sim_switch, item, panel_9, eval, flipnormals, analysisgrid])
hideshow_2 = HideShowObjectPreview(
    Visible=toggle_3,
    AllObjects_Object=[max_analysis_mesh_spacing_ds_en_17037, grid_ds_en_17037, distance_from_analysis_surface, distance_from_surface, U, U_2, dpipeline, referencesensorlayer, filterbasedongeometry, analysis_mesh_spacing_max_500mm_in_dk, boundary_offset, docunits_5, boundary_offset_2, panel_54, analysis_mesh_spacing_br18_or_ds_en_1703, python, fly, lng, panel_10, run_room, sensorgrid, central_sim_switch, item, panel_9, eval, flipnormals, analysisgrid])
onoff_2 = EnableDisableObject(
    Enabled=toggle_4,
    AllObjects_Object=[max_analysis_mesh_spacing_ds_en_17037, grid_ds_en_17037, distance_from_analysis_surface, distance_from_surface, U, U_2, dpipeline, referencesensorlayer, filterbasedongeometry, analysis_mesh_spacing_max_500mm_in_dk, boundary_offset, docunits_5, boundary_offset_2, panel_54, analysis_mesh_spacing_br18_or_ds_en_1703, python, fly, lng, panel_10, run_room, sensorgrid, central_sim_switch, item, panel_9, eval, flipnormals, analysisgrid])

toggle_5 = FalseStartToggle(False)
toggle_6 = FalseStartToggle(False)
wiredisplay_3 = ControlWireDisplay(WireDisplay=Slider(2, range=0..2))
hideshow_3 = HideShowObjectPreview(Visible=toggle_5)
onoff_3 = EnableDisableObject(Enabled=toggle_6)

# ----
# B) Simulation Setup
toggle_7 = FalseStartToggle(True)
orientation = Slider(0, range=-360..360)

# ----
# Simulation Parameters
number_slider = Slider(2, range=0..2)
recipte_type = Panel("""0
1""")
list = ValueList({"Illuminance (lux)": 0, "Radiation (kWh)": 1, "Luminance  (cd)": 2}, selected="Illuminance (lux)")

radpargridbased = HoneybeePlus_RadianceParametersGridBased(complexity=number_slider, recipe_type=recipte_type)  # -> report, rad_par, vmtx_par, dmtx_par, smtx_par; plug-in component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

# ----
# Recipe
panel_12 = Panel("-ab 3")
panel_13 = Panel("-ab 4")
panel_14 = Panel("-ab 6")
panel_15 = Panel("-ab 7")
rep = ReplaceText(Text=radpargridbased.rad_par, Find=panel_12, Replace=panel_13, RecursiveReplace=False)
rep_2 = ReplaceText(Text=radpargridbased.dmtx_par, Find=panel_14, Replace=panel_15, RecursiveReplace=False)
clean_4 = CleanTree(RemoveNulls=True, RemoveInvalid=True, RemoveEmpty=True, Tree=rep)
panel_16 = Panel(clean_4)
clean_5 = CleanTree(RemoveNulls=True, RemoveInvalid=True, RemoveEmpty=True, Tree=rep_2)
panel_17 = Panel(clean_5)

filename = Panel("""Legend
Nr.
Rendered
Sketch
Temp
Results""")  # disabled

# ----
# Weatherfile and North
open_weather_file = Ladybug_OpenEPWWeatherFile(open=toggle_7)  # -> epwFile; plug-in component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
importloc = LBImportLocation(epw_file=open_weather_file)  # -> location; plug-in component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
panel_18 = Panel(importloc)

# ----
# Analyze Weather Data
importepw = LBImportEPW(epw_file=open_weather_file)  # -> location, dry_bulb_temperature, dew_point_temperature, relative_humidity, wind_speed, wind_direction, direct_normal_rad, diffuse_horizontal_rad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; plug-in component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
hourlyplot = LBHourlyPlot(data=[importepw.dry_bulb_temperature, importepw.global_horizontal_ill, importepw.diffuse_horizontal_ill, importepw.direct_normal_ill])  # -> report, mesh, legend, borders, labels, title; plug-in component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

item_selector = ItemSelector(filename, {"Legend", "Nr.", "Rendered", "Sketch", "Temp", "Results", ""}, selected="Results")  # disabled

wea = HBWeaFromEPW(epw_file=open_weather_file)  # -> wea; plug-in component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

# ----
# Global
panel_19 = Panel("0")
panel_20 = Panel("12")
panel_21 = Panel("31")
panel_22 = Panel("23")
panel_23 = Panel("1")
panel_24 = Panel("1")

# ----
# Analysis period - Set yearly or
# sub-yearly  timespan for analysis
# - make sure your period matches your simulation criteria
analysisperiod = LBAnalysisPeriod(start_month=panel_23, start_day=panel_24, start_hour=panel_19, end_month=panel_20, end_day=panel_21, end_hour=panel_22)  # -> period, hoys, dates; plug-in component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

# ----
# BR18 Dagslystimer
importepw_2 = LBImportEPW(epw_file=open_weather_file)  # -> location, dry_bulb_temperature, dew_point_temperature, relative_humidity, wind_speed, wind_direction, direct_normal_rad, diffuse_horizontal_rad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; plug-in component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
xdata = LBDeconstructData(data=importepw_2.global_horizontal_ill)  # -> header, values; plug-in component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
medianoflist = GhPythonScript(x=xdata.values)  # -> out, a; inputs x: list
# ---------- medianoflist: Python ----------
__author__ = "ibc"
__version__ = "2020.11.04"

import rhinoscriptsyntax as rs
import statistics

items=x

a=statistics.median(items)

print(a)
#>>> 3
# ---------- end medianoflist ----------
panel_25 = Panel("1")
larger = LargerThan(FirstNumber=xdata.values, SecondNumber=medianoflist.a)  # -> LargerThan, OrEqualTo
int = Integer(larger.OrEqualTo)
panel_26 = Panel("BR18_Dagslystimer")
fixedintervalschedule = HBFixedIntervalSchedule(values=int, timestep=panel_25, analysis_period=analysisperiod.period, name=panel_26)  # -> report, schedule; plug-in component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
schtodata = HBScheduleToData(schedule=fixedintervalschedule.schedule)  # -> data; plug-in component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
xdata_2 = LBDeconstructData(data=schtodata)  # -> header, values; plug-in component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
panel_27 = Panel(xdata_2.values)
ma = MassAddition(Input=panel_27)  # -> Result, PartialResults
panel_28 = Panel(ma.Result)

panel_29 = Panel(int)

toggle_8 = FalseStartToggle(False)
toggle_9 = FalseStartToggle(True)
wiredisplay_4 = ControlWireDisplay(
    WireDisplay=Slider(2, range=0..2),
    AllObjects_Object=[panel_23, panel_24, panel_19, panel_20, panel_21, panel_22, orientation, panel_18, wea, open_weather_file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])
hideshow_4 = HideShowObjectPreview(
    Visible=toggle_8,
    AllObjects_Object=[panel_23, panel_24, panel_19, panel_20, panel_21, panel_22, orientation, panel_18, wea, open_weather_file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])
onoff_4 = EnableDisableObject(
    Enabled=toggle_9,
    AllObjects_Object=[panel_23, panel_24, panel_19, panel_20, panel_21, panel_22, orientation, panel_18, wea, open_weather_file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])

# ---- group: Orientering
cluster_10 = Cluster(x=orientation)  # -> pt_2, V

# ----
# Set North
swatch = ColourSwatch(SwatchColor=RGB(58, 140, 255))
panel_30 = Panel("10")
unit = UnitVector(Vector=cluster_10.V)
vdisex = VectorDisplayEx(Point=cluster_10.pt_2, Vector=cluster_10.V, Colour=swatch, Width=panel_30)

countcpus = CountCpus()  # -> AllCpus, CpusMinusOne, CpusMinusTwo, CpusThirds; disabled
# ---------- countcpus: Python ----------
__author__ = "ibc"
__version__ = "2020.11.04"

import rhinoscriptsyntax as rs

import System
count = System.Environment.ProcessorCount

AllCpus = count
CpusMinusOne = count-1
CpusMinusTwo = count -2  
CpusThirds = round(count/3)
# ---------- end countcpus ----------

name_of_dc_sim = Panel("Usefull Daylight Illuminance")  # disabled
toggle_10 = FalseStartToggle(False)  # disabled
list_2 = ValueList({"Threshold: BREEAM (100 lux)": 100, "Threshold: BR18 (300 lux)": 300, "Threshold: High (1000 lux)": 1000, "Threshold: Very High (3000)": 3000}, selected="Threshold: BR18 (300 lux)")  # disabled
and = GateAnd(A=central_sim_switch, B=toggle_10)  # disabled

# ----
# 3) Dynamic daylight calculations
toggle_11 = FalseStartToggle(False)
toggle_12 = FalseStartToggle(False)
hideshow_5 = HideShowObjectPreview(
    Visible=toggle_11,
    AllObjects_Object=[name_of_dc_sim_2, annualdaylight_2, runrecipe_2, toggle_13, area_2, match_2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])
wiredisplay_5 = ControlWireDisplay(
    WireDisplay=Slider(2, range=0..2),
    AllObjects_Object=[name_of_dc_sim_2, annualdaylight_2, runrecipe_2, toggle_13, area_2, match_2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])
onoff_5 = EnableDisableObject(
    Enabled=toggle_12,
    AllObjects_Object=[name_of_dc_sim_2, annualdaylight_2, runrecipe_2, toggle_13, area_2, match_2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])

countcpus_2 = CountCpus()  # -> AllCpus, CpusMinusOne, CpusMinusTwo, CpusThirds; disabled; same code as countcpus

name_of_dc_sim_2 = Panel("Daylight_Autonomy")  # disabled
list_3 = ValueList({"Threshold: BREEAM (100 lux)": 100, "Threshold: BR18 (300 lux)": 300, "Threshold: High (1000 lux)": 1000, "Threshold: Very High (3000)": 3000}, selected="Threshold: BR18 (300 lux)")  # disabled
toggle_13 = FalseStartToggle(False)  # disabled
and_2 = GateAnd(A=central_sim_switch, B=toggle_13)  # disabled

# ----
# Run Daylight Factor
name_of_df_sim = Panel("Daylight_Factor")
toggle_14 = FalseStartToggle(True)
and_3 = GateAnd(A=central_sim_switch, B=toggle_14)

# ----
# C) Simulations
# 1.a) Direct Daylight Study
# Analysisperiod (local)
list_4 = ValueList({"Determine analysis period locally": 0, "Determine analysis period globally": 1}, selected="Determine analysis period locally")
number_slider_2 = Slider(3, range=0..10)
number_slider_3 = Slider(21, range=0..100)
analysisperiod_2 = LBAnalysisPeriod(
    start_month=number_slider_2,
    start_day=number_slider_3,
    start_hour=Slider(0, range=0..23),
    end_month=number_slider_2,
    end_day=number_slider_3,
    end_hour=Slider(23, range=0..23))  # -> period, hoys, dates; plug-in component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

toggle_15 = FalseStartToggle(False)
toggle_16 = FalseStartToggle(False)
wiredisplay_6 = ControlWireDisplay(
    WireDisplay=Slider(2, range=0..2),
    AllObjects_Object=[annualmetrics_2, udi_f, udi_s, udi_c, udi_e, for_explanation_dobuble_click_me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])
hideshow_6 = HideShowObjectPreview(
    Visible=toggle_15,
    AllObjects_Object=[annualmetrics_2, udi_f, udi_s, udi_c, udi_e, for_explanation_dobuble_click_me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])
onoff_6 = EnableDisableObject(
    Enabled=toggle_16,
    AllObjects_Object=[annualmetrics_2, udi_f, udi_s, udi_c, udi_e, for_explanation_dobuble_click_me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])

# ----
# 2) Daylight Factor
toggle_17 = FalseStartToggle(False)
toggle_18 = FalseStartToggle(True)
wiredisplay_7 = ControlWireDisplay(
    WireDisplay=Slider(2, range=0..2),
    AllObjects_Object=[df_for_area_to_surpass, panel_55, area, mesh, results_4, match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])
hideshow_7 = HideShowObjectPreview(Visible=toggle_17, AllObjects_Object=[df_for_area_to_surpass, panel_55, area, mesh, results_4, match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])
onoff_7 = EnableDisableObject(Enabled=toggle_18, AllObjects_Object=[df_for_area_to_surpass, panel_55, area, mesh, results_4, match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])

for_explanation_dobuble_click_me = ForExplanationDobubleClickMe()  # disabled
udi_c = Panel("""100
2000""")  # disabled
udi_s = Panel("""100
300""")  # disabled
udi_f = Panel("""0
100""")  # disabled
udi_a = Panel("""300
2000""")  # disabled
udi_e = Panel("""2000
100000""")  # disabled

# ----
# Set Simulation Goals
list_5 = ValueList({"Low Target (20%)": 20, "BR18 Target (50%)": 50, "BREEAM target (80%)": 80, "High Target DS/EN 17037": 95}, selected="BR18 Target (50%)")  # disabled
equal_to_or_bigger_than = Panel(">=")  # disabled

# ----
# Set Simulation Goals
list_6 = ValueList({"Low Target (20%)": 20, "BR18 Target (50%)": 50, "BREEAM target (80%)": 80, "High Target DS/EN 17037": 95}, selected="BR18 Target (50%)")  # disabled
equal_to_or_bigger_than_2 = Panel(">=")  # disabled

toggle_19 = FalseStartToggle(False)
toggle_20 = FalseStartToggle(False)
wiredisplay_8 = ControlWireDisplay(WireDisplay=Slider(2, range=0..2))
hideshow_8 = HideShowObjectPreview(
    Visible=toggle_19,
    AllObjects_Object=[number_slider_4, flatten, analemma, swatch_2, daily, compass, preview, sun_pts, preview_2, preview_3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])
onoff_8 = EnableDisableObject(
    Enabled=toggle_20,
    AllObjects_Object=[number_slider_4, flatten, analemma, swatch_2, daily, compass, preview, sun_pts, preview_2, preview_3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])

equal_to_or_bigger_than_3 = Panel(">=")
# Set Simulation Goals
df_for_area_to_surpass = Panel("2")

panel_31 = Panel("{0,0,0}")  # disabled

# ---- group: Run me!
analyseflader = Panel("Overflade")  # disabled
skyggegivere = Panel("""0_context_0.20
0_wall_0.50
0_floor_0.20
0_ceiling_0.70""")  # disabled
falsestart = Ladybug_FalseStartToggle(False)  # disabled

# ----
# Run Direct Sun Study
number_slider_4 = Slider(2, range=0..10)  # disabled
simple_yes_no = SimpleYesNo(bool=list_4, Local=analysisperiod_2.hoys, Global=analysisperiod.hoys)  # -> out, flatten(a); inputs bool: Boolean, Local: list, Global: list; disabled
# ---------- simple_yes_no: Python ----------
import math


if bool == False:
    a=Local

if bool == True:
    a=Global
# ---------- end simple_yes_no ----------
flatten = FlattenTree(Tree=simple_yes_no.a, Path="{0}")  # disabled
sunpath = LBSunPath(north=unit, location=importloc, hoys=flatten, scale=number_slider_4)  # -> report, vectors, altitudes, azimuths, hoys, sun_pts, analemma, daily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; disabled; plug-in component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
cluster_11 = Cluster_3(B=analyseflader, B_2=skyggegivere)  # -> T, G; disabled
panel_32 = Panel("10mm")  # disabled
panel_33 = Panel("10000mm")  # disabled
docunits = ConvertToDocumentUnits(ValueString=panel_33)  # disabled
docunits_2 = ConvertToDocumentUnits(ValueString=panel_32)  # disabled
directsunhours = LBDirectSunHours(
    vectors=flatten(sunpath.vectors),
    geometry=flatten(cluster_11.T),
    context=flatten(cluster_11.G),
    grid_size=docunits,
    offset_dist=docunits_2,
    parallel=falsestart,
    run=falsestart)  # -> report, points, results, mesh, legend, title, int_mtx; disabled; plug-in component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
data_3 = Data(directsunhours.legend)  # disabled

vec2pt = Vector2Pt(PointA=panel_31, PointB=sunpath.sun_pts, Unitize=False)  # -> Vector, Length; disabled
number_slider_5 = Slider(0, range=0..360)
vdisex_2 = VectorDisplayEx(Point=panel_31, Vector=vec2pt.Vector, Colour=RGB(0, 0, 0), Width=2)  # disabled
brep = Brep([<brep referenced from the Rhino model> x3])

# ----
# Bake To Layers
mesh_contour = FalseStartToggle(False)
panel_34 = Panel("01_daylight_Results::DF")
results = FalseStartToggle(False)

toggle_21 = FalseStartToggle(False)
hideshow_9 = HideShowObjectPreview(Visible=toggle_21)

swatch_2 = ColourSwatch(SwatchColor=RGB(241, 255, 0))  # disabled
swatch_3 = ColourSwatch(SwatchColor=RGB(53, 35, 162))  # disabled
sun_pts = Point(sunpath.sun_pts)  # disabled
swatch_4 = ColourSwatch(SwatchColor=RGB(4, 0, 0))  # disabled
compass = Geometry(sunpath.compass)  # disabled
analemma = Curve(sunpath.analemma)  # disabled
swatch_5 = ColourSwatch(SwatchColor=RGB(6, 0, 162))  # disabled
daily = Curve(sunpath.daily)  # disabled
cull = CullPattern(
    List=sun_pts,
    CullPattern=[False, False, False, False, False, False, True, False, False, False, False, False, False, False, True])  # disabled
preview = CustomPreview(Geometry=analemma, Material=swatch_3)  # disabled
preview_2 = CustomPreview(Geometry=daily, Material=swatch_5)  # disabled
preview_3 = CustomPreview(Geometry=compass, Material=swatch_4)  # disabled
preview_4 = CustomPreview(Geometry=cull, Material=swatch_2)  # disabled

and_4 = GateAnd(A=results, B=toggle_14)

and_5 = GateAnd(A=mesh_contour, B=toggle_14)

toggle_22 = FalseStartToggle(False)  # disabled
hideshow_10 = HideShowObjectPreview(Visible=toggle_22)  # disabled

# ----
# Bake To Layers
panel_35 = Panel("01_daylight_Results::DA")  # disabled
mesh_contour_2 = FalseStartToggle(False)  # disabled
results_2 = FalseStartToggle(False)  # disabled

# ----
# Mesh
panel_36 = Panel("01_daylight_Results::Sunacces::Direct_sun_simulation")  # disabled
toggle_23 = FalseStartToggle(False)  # disabled
swatch_6 = ColourSwatch(SwatchColor=RGB(0, 0, 0))  # disabled

# ----
# Bake To Layers
mesh_contour_3 = FalseStartToggle(False)  # disabled
results_3 = FalseStartToggle(False)  # disabled

panel_37 = Panel("01_daylight_Results::UDI")  # disabled
and_6 = GateAnd(A=mesh_contour_3, B=toggle_10)  # disabled
and_7 = GateAnd(A=results_3, B=toggle_10)  # disabled

and_8 = GateAnd(A=results_2, B=toggle_13)  # disabled

and_9 = GateAnd(A=mesh_contour_2, B=toggle_13)  # disabled

panel_38 = Panel("Sun Mesh")  # disabled
onoff_9 = EnableDisableObject(Enabled=toggle_23)  # disabled
layers = CreateModifyLayers(LayerName=panel_36, DeleteLayer=False, enableFullPath=True)  # -> LayerNames, LayerFullPath; disabled
createatts = CreateAttributes(Name=panel_38, LayerName=layers.LayerFullPath, Color=swatch_6, enableFullPath=True)  # disabled
bake = BakeObject(ObjectAttributes=createatts, Bake=toggle_23)  # disabled

toggle_24 = FalseStartToggle(False)
toggle_25 = FalseStartToggle(False)
enable_disable_object = EnableDisableObject(Enabled=toggle_25)
hideshow_11 = HideShowObjectPreview(Visible=toggle_24)

value_list = ValueList({"Default", "Default 01"}, selected="Default")
panel_39 = Panel("::Sub Results")

value_list_2 = ValueList({"Default", "Default 01"}, selected="Default 01")
panel_40 = Panel("::Room Result")

toggle_26 = FalseStartToggle(False)
toggle_27 = FalseStartToggle(False)
enable_disable_object_2 = EnableDisableObject(Enabled=toggle_27)
hideshow_12 = HideShowObjectPreview(Visible=toggle_26)

panel_41 = Panel("::Room Result")  # disabled
value_list_3 = ValueList({"Default", "Default 01"}, selected="Default 01")  # disabled

value_list_4 = ValueList({"Default", "Default 01"}, selected="Default 01")  # disabled
panel_42 = Panel("::Sub Results")  # disabled

toggle_28 = FalseStartToggle(False)
toggle_29 = FalseStartToggle(False)
onoff_10 = EnableDisableObject(Enabled=toggle_29)
hideshow_13 = HideShowObjectPreview(Visible=toggle_28)

value_list_5 = ValueList({"Default", "Default 01"}, selected="Default")  # disabled
panel_43 = Panel("::Sub Results")  # disabled

value_list_6 = ValueList({"Default", "Default 01"}, selected="Default 01")  # disabled
panel_44 = Panel("::Room Result")  # disabled

# ----
# 1.b) Radiation Study
toggle_30 = FalseStartToggle(False)
toggle_31 = FalseStartToggle(False)
wiredisplay_9 = ControlWireDisplay(WireDisplay=Slider(2, range=0..2))
hideshow_14 = HideShowObjectPreview(Visible=toggle_30)
onoff_11 = EnableDisableObject(Enabled=toggle_31)

value_list_7 = ValueList({"Default", "Default 01"}, selected="Default 01")
panel_45 = Panel("::Area")

# ---- group: Run Me!
panel_46 = Panel("SimSurf")  # disabled
falsestart_2 = Ladybug_FalseStartToggle(False)  # disabled

# ----
# Run Radiation Study
simple_yes_no_2 = SimpleYesNo(bool=list_4, Local=analysisperiod_2.hoys, Global=analysisperiod.hoys)  # -> out, flatten(a); inputs bool: Boolean, Local: list, Global: list; disabled; same code as simple_yes_no
flatten_2 = FlattenTree(Tree=simple_yes_no_2.a, Path="{0}")  # disabled
list_7 = ValueList({"False": 0, "True": 1}, selected="False")  # disabled
diff_rad = Data(importepw.diffuse_horizontal_rad)  # disabled
norm_rad = Data(importepw.direct_normal_rad)  # disabled
skymatrix = LBCumulativeSkyMatrix(north=unit, location=importloc, direct_rad=norm_rad, diffuse_rad=diff_rad, hoys=flatten_2, high_density=list_7)  # -> report, sky_mtx; disabled; plug-in component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
cluster_12 = Cluster_3(B=panel_46)  # -> T, G; disabled
panel_47 = Panel("10mm")  # disabled
panel_48 = Panel("10000mm")  # disabled
geo = Geometry(cluster_12.T)  # disabled
sort_brep = SortDuplicateBreps(Breps=cluster_12.G)  # -> UniqueBreps, Indices; disabled
sort_brep_2 = SortDuplicateBreps(Breps=geo)  # -> UniqueBreps, Indices; disabled
docunits_3 = ConvertToDocumentUnits(ValueString=panel_47)  # disabled
docunits_4 = ConvertToDocumentUnits(ValueString=panel_48)  # disabled
incidentradiation = LBIncidentRadiation(
    sky_mtx=skymatrix.sky_mtx,
    geometry=flatten(sort_brep_2.UniqueBreps),
    context=flatten(sort_brep.UniqueBreps),
    grid_size=docunits_4,
    offset_dist=docunits_3,
    parallel=falsestart_2,
    run=falsestart_2)  # -> report, points, results, total, mesh, legend, title, int_mtx; disabled; plug-in component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

value_list_8 = ValueList({"Default", "Default 01"}, selected="Default 01")  # disabled
panel_49 = Panel("::Area")  # disabled

value_list_9 = ValueList({"Default", "Default 01"}, selected="Default 01")  # disabled
panel_50 = Panel("::Area")  # disabled

toggle_32 = FalseStartToggle(False)
# Trim Surface
# Get boundary vertices
# Make Surface
# Scale results to z-value
# Result "Landscape"
# Max/Min
hideshow_15 = HideShowObjectPreview(Visible=toggle_32)

swatch_7 = ColourSwatch(SwatchColor=RGB(53, 35, 162))  # disabled
swatch_8 = ColourSwatch(SwatchColor=RGB(241, 255, 0))  # disabled
daily_2 = Curve()  # disabled
swatch_9 = ColourSwatch(SwatchColor=RGB(6, 0, 162))  # disabled
sun_pts_2 = Point()  # disabled
swatch_10 = ColourSwatch(SwatchColor=RGB(4, 0, 0))  # disabled
analemma_2 = Curve()  # disabled
compass_2 = Geometry()  # disabled
cull_2 = CullPattern(
    List=sun_pts_2,
    CullPattern=[False, False, False, False, False, False, True, False, False, False, False, False, False, False, True])  # disabled
preview_5 = CustomPreview(Geometry=analemma_2, Material=swatch_7)  # disabled
preview_6 = CustomPreview(Geometry=cull_2, Material=swatch_8)  # disabled
preview_7 = CustomPreview(Geometry=daily_2, Material=swatch_9)  # disabled
preview_8 = CustomPreview(Geometry=compass_2, Material=swatch_10)  # disabled

# ----
# Mesh
panel_51 = Panel("01_daylight_Results::Radiation")  # disabled
toggle_33 = FalseStartToggle(False)  # disabled
panel_52 = Panel("Sun Mesh")  # disabled
swatch_11 = ColourSwatch(SwatchColor=RGB(0, 0, 0))  # disabled

onoff_12 = EnableDisableObject(Enabled=toggle_33)  # disabled
layers_2 = CreateModifyLayers(LayerName=panel_51, DeleteLayer=False, enableFullPath=True)  # -> LayerNames, LayerFullPath; disabled
# Remapping Values
# Remapping min values
# Remapping max values
# Genererer konturkurver (Flat)
# RetningsVektorer
# Genererer konturkurver (Grafted)
createatts_2 = CreateAttributes(Name=panel_52, LayerName=layers_2.LayerFullPath, Color=swatch_11, enableFullPath=True)  # disabled
bake_2 = BakeObject(ObjectAttributes=createatts_2, Bake=toggle_33)  # disabled

# ----
# Daylight-model
model = HBModel(faces=flatten(clean), shades=flatten(clean_2), apertures=flatten(clean_3), name=name_of_project)  # -> report, model; plug-in component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
vizall = HBVizualizeAll(hb_objs=flatten(clean_3))  # -> geo; plug-in component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
panel_53 = Panel(model.model)

grid_ds_en_17037 = GRIDDSEN17037(brep=item)
U = ConvertToDocumentUnits(ValueString=distance_from_analysis_surface)
docunits_5 = ConvertToDocumentUnits(ValueString=boundary_offset)
boundary_offset_2 = Panel(docunits_5)
distance_from_surface = Panel(U)
panel_54 = Panel("Sensors")

data_4 = Data(flatten([grid_ds_en_17037, analysis_mesh_spacing_max_500mm_in_dk]))

max_analysis_mesh_spacing_ds_en_17037 = Panel(data_4)
python = PythonScript(method=analysis_mesh_spacing_br18_or_ds_en_1703, space=data_4)  # -> out, a; inputs space: list
# ---------- python: Python ----------
import math


if method == 0:
    a=space[0]

elif method == 1:
    a=space[1]

elif method == 2:
    a=space[2]
# ---------- end python ----------
U_2 = ConvertToDocumentUnits(ValueString=python.a)
analysisgrid = AnalysisGrid(A=distance_from_surface, brep=item, D=boundary_offset_2, B_2=U_2, B=flipnormals)  # -> L, L_2, M, A_2, L_3
sensorgrid = HBSensorGrid(name=panel_54, positions=analysisgrid.L, directions=analysisgrid.L_2, mesh=analysisgrid.M)  # -> grid; plug-in component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

assigngridsviews = HBAssignGridsAndViews(model=model.model, grids=flatten(sensorgrid))  # -> model; plug-in component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

# ----
# b) Usefull Daylight Autonomy
# Run the simulation
annualdaylight = HBAnnualDaylight(model=assigngridsviews, wea=wea, north=unit, sensor_count=200, radiance_parameters=panel_17)  # -> recipe; disabled; plug-in component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
runrecipe = HBRunRecipe(recipe=annualdaylight, cpu_count=countcpus.CpusThirds, run=and)  # -> report, results; disabled; plug-in component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

# ----
# a) Daylight Autonomy
# Run the simulation
annualdaylight_2 = HBAnnualDaylight(model=assigngridsviews, wea=wea, north=unit, sensor_count=200, radiance_parameters=panel_17)  # -> recipe; disabled; plug-in component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
runrecipe_2 = HBRunRecipe(recipe=annualdaylight_2, cpu_count=countcpus_2.CpusThirds, run=toggle_13)  # -> report, results; disabled; plug-in component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
annualmetrics = HBAnnualDaylightMetrics(results=runrecipe_2.results, occ_sch=fixedintervalschedule.schedule, threshold=list_3)  # -> report, DA, UDI; disabled; plug-in component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

# ----
# Run the simulation
countcpus_3 = CountCpus()  # -> AllCpus, CpusMinusOne, CpusMinusTwo
# ---------- countcpus_3: Python ----------
__author__ = "ibc"
__version__ = "2020.11.04"

import rhinoscriptsyntax as rs

import System
count = System.Environment.ProcessorCount

AllCpus = count
CpusMinusOne = count-1
CpusMinusTwo = count -2
# ---------- end countcpus_3 ----------
daylightfactor = HBDaylightFactor(model=assigngridsviews, sensor_count=200, radiance_parameters="-ab 2")  # -> recipe; plug-in component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
runrecipe_3 = HBRunRecipe(recipe=daylightfactor, cpu_count=countcpus_3.CpusMinusOne, run=toggle_14)  # -> report, results; plug-in component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
file = ReadFile(File=runrecipe_3.results, PerLineParse=True)
panel_55 = Panel(file)

# ----
# Mesh, results and analysis surface
mesh = Mesh(simplify(graft(analysisgrid.M)))
results_4 = Number(simplify(file))
test_surfaces = Brep(item)
pt = Point(analysisgrid.L)
area = Area(Geometry=mesh)  # -> Area, Centroid
match = MatchTree(Tree=results_4, Guide=mesh)
panel_56 = Panel(match)

entwine = Entwine(Branch00=udi_f, Branch01=udi_s, Branch02=udi_a, Branch03=udi_c, Branch04=udi_e, FlattenInputs=True)  # disabled
annualmetrics_2 = HBAnnualDaylightMetrics(results=runrecipe.results, occ_sch=fixedintervalschedule.schedule, min_max=udi_c)  # -> report, DA, UDI; disabled; plug-in component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

lng_2 = ListLength(List=annualmetrics_2.UDI)  # disabled
division = Division(A=lng_2, B=5)  # disabled
partition = PartitionList(List=annualmetrics_2.UDI, Size=division)  # disabled

# ----
# IsoCurve and Gradient mesh
toggle_34 = BooleanToggle(False)
topography_v_1_0 = TopographyV10(srf=analysisgrid.L_3, pt=pt, results=file, B=toggle_34)  # -> remapped_numbers_2, vertices_2, face_2, colors_2, mesh_3, crv_6, pln_2
project = Project(Geometry=simplify(topography_v_1_0.crv_6), Plane=area.Centroid)  # -> Geometry, Transform
project_2 = Project(Geometry=topography_v_1_0.mesh_3, Plane=area.Centroid)  # -> Geometry, Transform

# ----
# Mesh, results and analysis surface
results_5 = Number()  # disabled
mesh_2 = Mesh(simplify(graft(analysisgrid.M)))  # disabled
pt_2 = Point()  # disabled
test_surfaces_2 = Brep(analysisgrid.L_3)  # disabled
match_2 = MatchTree(Tree=results_5, Guide=mesh_2)  # disabled
area_2 = Area(Geometry=mesh_2)  # -> Area, Centroid; disabled
panel_57 = Panel(match_2)  # disabled

panel_58 = Panel("100")  # disabled
meshselector = Ladybug_MeshThresholdSelector(
    inputMesh=mesh_2,
    analysisResult=match_2,
    operator=equal_to_or_bigger_than,
    percentToKeep=panel_58,
    levelOfPerform=list_5)  # -> readMe, totalValue, areaMeetsThresh, newColoredMesh, newMeshOutline; disabled; plug-in component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

# ----
# Mesh, results and analysis surface
pt_3 = Point(analysisgrid.L)  # disabled
mesh_3 = Mesh(simplify(graft(analysisgrid.M)))  # disabled
results_6 = Number(simplify(annualmetrics_2.UDI))  # disabled
test_surfaces_3 = Brep(item)  # disabled
area_3 = Area(Geometry=mesh_3)  # -> Area, Centroid; disabled
panel_59 = Panel(results_6)  # disabled

panel_60 = Panel("100")  # disabled
panel_61 = Panel(">=")  # disabled
meshselector_2 = Ladybug_MeshThresholdSelector(inputMesh=mesh_3, analysisResult=results_6, operator=panel_61, percentToKeep=panel_60, levelOfPerform=list_6)  # -> readMe, totalValue, areaMeetsThresh, newColoredMesh, newMeshOutline; disabled; plug-in component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

panel_62 = Panel("100")
meshselector_3 = Ladybug_MeshThresholdSelector(
    inputMesh=mesh,
    analysisResult=match,
    operator=equal_to_or_bigger_than_3,
    percentToKeep=panel_62,
    levelOfPerform=df_for_area_to_surpass)  # -> readMe, totalValue, areaMeetsThresh, newColoredMesh, newMeshOutline; plug-in component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

# ----
# Uniformity
avr = Average(Input=results_5)  # disabled
bnd = Bounds(Numbers=results_5)  # disabled
dedomain = DeconstructDomain(Domain=bnd)  # -> Start, End; disabled
division_2 = Division(A=dedomain.Start, B=avr)  # disabled

# ----
# Uniformity
bnd_2 = Bounds(Numbers=results_6)  # disabled
avr_2 = Average(Input=results_6)  # disabled
dedomain_2 = DeconstructDomain(Domain=bnd_2)  # -> Start, End; disabled
division_3 = Division(A=dedomain_2.Start, B=avr_2)  # disabled

# ----
# IsoCurve and Gradient mesh
topography_v_1_0_2 = TopographyV10(srf=test_surfaces_2, pt=pt_2, results=results_5)  # -> remapped_numbers_2, vertices_2, face_2, colors_2, mesh_3, crv_6, pln_2; disabled
project_3 = Project(Geometry=simplify(topography_v_1_0_2.crv_6), Plane=topography_v_1_0_2.pln_2)  # -> Geometry, Transform; disabled
project_4 = Project(Geometry=topography_v_1_0_2.mesh_3, Plane=topography_v_1_0_2.pln_2)  # -> Geometry, Transform; disabled
group = Group(Objects=flatten(project_3.Geometry))  # disabled
group_2 = Group(Objects=project_4.Geometry)  # disabled

daylight_factor = Expression(x=avr_2, Expression="Format(\"The floor area has an average usefull daylight illuminance of {0:0}%\",x)")  # disabled
daylight_factor_2 = Expression(
    x=area_3.Area,
    y=meshselector_2.areaMeetsThresh,
    z=list_6,
    Expression="Format(\"{00:0}% of the floor area is above UDI {1}%\", y/x*100, z)")  # disabled

daylight_factor_3 = Expression(x=avr, Expression="Format(\"The floor area has an average daylight autonomy of {0:0}%\",x)")  # disabled
daylight_factor_4 = Expression(
    x=area_2.Area,
    y=meshselector.areaMeetsThresh,
    z=list_5,
    Expression="Format(\"{00:0}% of the floor area is above DA {1}%\", y/x*100, z)")  # disabled

# ----
# Uniformity
avr_3 = Average(Input=results_4)
bnd_3 = Bounds(Numbers=results_4)
dedomain_3 = DeconstructDomain(Domain=bnd_3)  # -> Start, End
division_4 = Division(A=dedomain_3.Start, B=avr_3)

# ----
# IsoCurve and Gradient mesh
topography_v_1_0_3 = TopographyV10(srf=analysisgrid.L_3, pt=pt_3, results=results_6)  # -> remapped_numbers_2, vertices_2, face_2, colors_2, mesh_3, crv_6, pln_2; disabled
project_5 = Project(Geometry=simplify(topography_v_1_0_3.crv_6), Plane=area_3.Centroid)  # -> Geometry, Transform; disabled
project_6 = Project(Geometry=topography_v_1_0_3.mesh_3, Plane=area_3.Centroid)  # -> Geometry, Transform; disabled
group_3 = Group(Objects=flatten(project_5.Geometry))  # disabled
group_4 = Group(Objects=project_6.Geometry)  # disabled

daylight_factor_5 = Expression(x=avr_3, Expression="Format(\"The floor area has an average daylight factor of {0:0}%\",x)")
daylight_factor_6 = Expression(
    x=area.Area,
    y=meshselector_3.areaMeetsThresh,
    z=df_for_area_to_surpass,
    Expression="Format(\"{00:0}% of the floor area is above DF {1}%\", y/x*100, z)")

# ----
# Legend
panel_63 = Panel(name_of_df_sim)
panel_64 = Panel("24")
panel_65 = Panel("0")
panel_66 = Panel("0")
panel_67 = Panel("7")
legendpar = LBLegendParameters(min=panel_66, max=panel_64, seg_count=panel_67, colors=topography_v_1_0.colors_2, num_decimals=panel_65)  # -> leg_par; plug-in component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
heatmap = LBSpatialHeatmap(values=results_4, mesh=mesh, legend_par=legendpar, legend_title=panel_63, global_title=daylight_factor_5)  # -> mesh, legend, title, colors, legend_par; plug-in component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
data_5 = Data([heatmap.legend, heatmap.title])

faceb = FaceBoundaries(Mesh=mesh_2)  # disabled
area_4 = Area(Geometry=faceb)  # -> simplify(graft(Area)), Centroid; disabled

# ----
# Area
division_5 = Division(A=meshselector.areaMeetsThresh, B=area_2.Area)  # disabled
panel_68 = Panel("mm2")  # disabled
panel_69 = Panel("m2")  # disabled
ma_2 = MassAddition(Input=flatten(area_4.Area))  # -> Result, PartialResults; disabled
units = LBUnitConverter(values=ma_2.Result, from_u=panel_68, to_u=panel_69)  # -> all_u, values; disabled; plug-in component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
cluster_13 = Cluster_7(L=ma_2.Result, L_2=units.values, A=U_2)  # -> L_3, L_4; disabled
data_6 = Data([cluster_13.L_3, cluster_13.L_4])  # disabled

faceb_2 = FaceBoundaries(Mesh=mesh_3)  # disabled
area_5 = Area(Geometry=faceb_2)  # -> simplify(Area), Centroid; disabled

# ----
# Area
division_6 = Division(A=meshselector_2.areaMeetsThresh, B=area_3.Area)  # disabled
panel_70 = Panel("m2")  # disabled
panel_71 = Panel("mm2")  # disabled
ma_3 = MassAddition(Input=flatten(area_5.Area))  # -> Result, PartialResults; disabled
units_2 = LBUnitConverter(values=ma_3.Result, from_u=panel_71, to_u=panel_70)  # -> all_u, values; disabled; plug-in component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
cluster_14 = Cluster_7(L=ma_3.Result, L_2=units_2.values, A=distance_from_surface)  # -> L_3, L_4; disabled
data_7 = Data([cluster_14.L_3, cluster_14.L_4])  # disabled

faceb_3 = FaceBoundaries(Mesh=mesh)
area_6 = Area(Geometry=faceb_3)  # -> simplify(graft(Area)), Centroid

# ----
# Area
panel_72 = Panel("m2")
panel_73 = Panel("mm2")
ma_4 = MassAddition(Input=flatten(area_6.Area))  # -> Result, PartialResults
units_3 = LBUnitConverter(values=ma_4.Result, from_u=panel_72, to_u=panel_73)  # -> all_u, values; plug-in component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
cluster_15 = Cluster_7(L=ma_4.Result, L_2=units_3.values, A=distance_from_surface)  # -> L_3, L_4
data_8 = Data([cluster_15.L_3, cluster_15.L_4])

# ----
# Legend
panel_74 = Panel(name_of_dc_sim)  # disabled
panel_75 = Panel("0")  # disabled
panel_76 = Panel("0")  # disabled
panel_77 = Panel("100")  # disabled
panel_78 = Panel("11")  # disabled
legendpar_2 = LBLegendParameters(min=panel_76, max=panel_77, seg_count=panel_78, colors=topography_v_1_0_3.colors_2, num_decimals=panel_75)  # -> leg_par; disabled; plug-in component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
heatmap_2 = LBSpatialHeatmap(values=results_6, mesh=mesh_3, legend_par=legendpar_2, legend_title=panel_74, global_title=daylight_factor_2)  # -> mesh, legend, title, colors, legend_par; disabled; plug-in component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
data_9 = Data(heatmap_2.legend)  # disabled
data_10 = Data([heatmap_2.legend, heatmap_2.title])  # disabled

room_area_m2 = Panel(data_6)  # disabled
sudd_area = Panel(area_4.Area)  # disabled
average_da = Panel(avr)  # disabled
area_above_50_da = Panel(daylight_factor_4)  # disabled
lowest_df_of_room_da = Panel(dedomain.Start)  # disabled
uniformity = Panel(division_2)  # disabled

# ----
# Legend
panel_79 = Panel("0")  # disabled
panel_80 = Panel("100")  # disabled
panel_81 = Panel("11")  # disabled
panel_82 = Panel("0")  # disabled
panel_83 = Panel(name_of_dc_sim_2)  # disabled
legendpar_3 = LBLegendParameters(min=panel_79, max=panel_80, seg_count=panel_81, num_decimals=panel_82)  # -> leg_par; disabled; plug-in component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
heatmap_3 = LBSpatialHeatmap(values=results_5, mesh=mesh_2, legend_par=legendpar_3, legend_title=panel_83, global_title=daylight_factor_4)  # -> mesh, legend, title, colors, legend_par; disabled; plug-in component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
data_11 = Data([heatmap_3.legend, heatmap_3.title])  # disabled

room_area_m2_2 = Panel(data_7)  # disabled
sudd_area_2 = Panel(area_5.Area)  # disabled
area_above_50_da_2 = Panel(daylight_factor_2)  # disabled
average_da_2 = Panel(avr_2)  # disabled
lowest_df_of_room_da_2 = Panel(dedomain_2.Start)  # disabled
uniformity_2 = Panel(division_3)  # disabled

room_area_m2_3 = Panel(data_8)
sudd_area_3 = Panel(area_6.Area)
average_df = Panel(avr_3)
area_above_2_df = Panel(daylight_factor_6)
uniformity_3 = Panel(division_4)
lowest_df_of_room_df = Panel(dedomain_3.Start)

panel_84 = Panel("::Mesh")
concat = Concatenate(FragmentA=panel_34, FragmentB=panel_84)
define_object_attributes = DefineObjectAttributes(Layer=concat)
bake_objects = BakeObjects(Geometry=project_2.Geometry, Attributes=define_object_attributes, Bake=and_5)

lng_3 = ListLength(List=pt)
round = Round(Number=expr("x*100", division_4))  # -> Nearest, Floor, Ceiling
panel_85 = Panel("2")
division_7 = Division(A=lng_3, B=panel_85)
concat_2 = Concatenate(FragmentA=panel_34, FragmentB=panel_40)
round_2 = Round(Number=division_7)  # -> Nearest, Floor, Ceiling
panel_86 = Panel("%")
concat_3 = Concatenate(FragmentA=round.Nearest, FragmentB=panel_86)
item_2 = ListItem(List=pt, Index=round_2.Nearest, Wrap=True)
define_text_object = DefineTextObject(Text=concat_3, Plane=item_2, DimensionStyle=value_list_2, OutputType="Text")
define_object_attributes_2 = DefineObjectAttributes(Layer=concat_2)
group_5 = Group(Objects=define_text_object)
bake_modify_layer = BakeModifyLayer(Layer=concat_2, Bake=and_4)
bake_objects_2 = BakeObjects(Geometry=group_5, Attributes=define_object_attributes_2, Bake=and_4)

panel_87 = Panel("::Mesh")  # disabled
concat_4 = Concatenate(FragmentA=panel_35, FragmentB=panel_87)  # disabled
define_object_attributes_3 = DefineObjectAttributes(Layer=concat_4)  # disabled
bake_objects_3 = BakeObjects(Geometry=group_2, Attributes=define_object_attributes_3, Bake=and_9)  # disabled

round_3 = Round(Number=results_4)  # -> Nearest, Floor, Ceiling
concat_5 = Concatenate(FragmentA=panel_34, FragmentB=panel_39)
define_text_object_2 = DefineTextObject(Text=round_3.Nearest, Plane=pt, DimensionStyle=value_list, OutputType="Text")
define_object_attributes_4 = DefineObjectAttributes(Layer=concat_5)
group_6 = Group(Objects=define_text_object_2)
bake_objects_4 = BakeObjects(Geometry=group_6, Attributes=define_object_attributes_4, Bake=and_4)
bake_modify_layer_2 = BakeModifyLayer(Layer=concat_5, Bake=and_4)

panel_88 = Panel("::Mesh")  # disabled
concat_6 = Concatenate(FragmentA=panel_37, FragmentB=panel_88)  # disabled
define_object_attributes_5 = DefineObjectAttributes(Layer=concat_6)  # disabled
bake_objects_5 = BakeObjects(Geometry=group_4, Attributes=define_object_attributes_5, Bake=and_6)  # disabled

panel_89 = Panel("::Contour")
concat_7 = Concatenate(FragmentA=panel_34, FragmentB=panel_89)
define_object_attributes_6 = DefineObjectAttributes(Layer=concat_7)
bake_objects_6 = BakeObjects(Geometry=project.Geometry, Attributes=define_object_attributes_6, Bake=and_5)

lng_4 = ListLength(List=pt_2)  # disabled
round_4 = Round(Number=expr("x*100", division_5))  # -> Nearest, Floor, Ceiling; disabled
panel_90 = Panel("2")  # disabled
division_8 = Division(A=lng_4, B=panel_90)  # disabled
concat_8 = Concatenate(FragmentA=panel_35, FragmentB=panel_41)  # disabled
panel_91 = Panel("%")  # disabled
round_5 = Round(Number=division_8)  # -> Nearest, Floor, Ceiling; disabled
concat_9 = Concatenate(FragmentA=round_4.Nearest, FragmentB=panel_91)  # disabled
item_3 = ListItem(List=pt_2, Index=round_5.Nearest, Wrap=True)  # disabled
define_text_object_3 = DefineTextObject(Text=concat_9, Plane=item_3, DimensionStyle=value_list_3, OutputType="Text")  # disabled
define_object_attributes_7 = DefineObjectAttributes(Layer=concat_8)  # disabled
group_7 = Group(Objects=define_text_object_3)  # disabled
bake_modify_layer_3 = BakeModifyLayer(Layer=concat_8, Bake=and_8)  # disabled
bake_objects_7 = BakeObjects(Geometry=group_7, Attributes=define_object_attributes_7, Bake=and_8)  # disabled

concat_10 = Concatenate(FragmentA=panel_35, FragmentB=panel_42)  # disabled
round_6 = Round(Number=results_5)  # -> Nearest, Floor, Ceiling; disabled
define_text_object_4 = DefineTextObject(Text=round_6.Nearest, Plane=pt_2, DimensionStyle=value_list_4, OutputType="Text")  # disabled
define_object_attributes_8 = DefineObjectAttributes(Layer=concat_10)  # disabled
group_8 = Group(Objects=define_text_object_4)  # disabled
bake_modify_layer_4 = BakeModifyLayer(Layer=concat_10, Bake=and_8)  # disabled
bake_objects_8 = BakeObjects(Geometry=group_8, Attributes=define_object_attributes_8, Bake=and_8)  # disabled

lng_5 = ListLength(List=pt_3)  # disabled
round_7 = Round(Number=expr("x*100", division_6))  # -> Nearest, Floor, Ceiling; disabled
panel_92 = Panel("2")  # disabled
division_9 = Division(A=lng_5, B=panel_92)  # disabled
concat_11 = Concatenate(FragmentA=panel_37, FragmentB=panel_44)  # disabled
round_8 = Round(Number=division_9)  # -> Nearest, Floor, Ceiling; disabled
panel_93 = Panel("%")  # disabled
concat_12 = Concatenate(FragmentA=round_7.Nearest, FragmentB=panel_93)  # disabled
item_4 = ListItem(List=pt_3, Index=round_8.Nearest, Wrap=True)  # disabled
define_text_object_5 = DefineTextObject(Text=concat_12, Plane=item_4, DimensionStyle=value_list_6, OutputType="Text")  # disabled
define_object_attributes_9 = DefineObjectAttributes(Layer=concat_11)  # disabled
group_9 = Group(Objects=define_text_object_5)  # disabled
bake_modify_layer_5 = BakeModifyLayer(Layer=concat_11, Bake=and_7)  # disabled
bake_objects_9 = BakeObjects(Geometry=group_9, Attributes=define_object_attributes_9, Bake=and_7)  # disabled

round_9 = Round(Number=results_6)  # -> Nearest, Floor, Ceiling; disabled
concat_13 = Concatenate(FragmentA=panel_37, FragmentB=panel_43)  # disabled
define_text_object_6 = DefineTextObject(Text=round_9.Nearest, Plane=pt_3, DimensionStyle=value_list_5, OutputType="Text")  # disabled
define_object_attributes_10 = DefineObjectAttributes(Layer=concat_13)  # disabled
group_10 = Group(Objects=define_text_object_6)  # disabled
bake_objects_10 = BakeObjects(Geometry=group_10, Attributes=define_object_attributes_10, Bake=and_7)  # disabled
bake_modify_layer_6 = BakeModifyLayer(Layer=concat_13, Bake=and_7)  # disabled

panel_94 = Panel("::Contour")  # disabled
concat_14 = Concatenate(FragmentA=panel_35, FragmentB=panel_94)  # disabled
define_object_attributes_11 = DefineObjectAttributes(Layer=concat_14)  # disabled
bake_objects_11 = BakeObjects(Geometry=group, Attributes=define_object_attributes_11, Bake=and_9)  # disabled

panel_95 = Panel("::Contour")  # disabled
concat_15 = Concatenate(FragmentA=panel_37, FragmentB=panel_95)  # disabled
define_object_attributes_12 = DefineObjectAttributes(Layer=concat_15)  # disabled
bake_objects_12 = BakeObjects(Geometry=group_3, Attributes=define_object_attributes_12, Bake=and_6)  # disabled

panel_96 = Panel("::Legend")
concat_16 = Concatenate(FragmentA=panel_34, FragmentB=panel_96)
define_object_attributes_13 = DefineObjectAttributes(Layer=concat_16)
bake_objects_13 = BakeObjects(Geometry=data_5, Attributes=define_object_attributes_13, Bake=False)

panel_97 = Panel("::Legend")  # disabled
concat_17 = Concatenate(FragmentA=panel_35, FragmentB=panel_97)  # disabled
define_object_attributes_14 = DefineObjectAttributes(Layer=concat_17)  # disabled
bake_objects_14 = BakeObjects(Geometry=data_11, Attributes=define_object_attributes_14, Bake=and_9)  # disabled

lng_6 = ListLength(List=pt)
round_10 = Round(Number=room_area_m2_3)  # -> Nearest, Floor, Ceiling
panel_98 = Panel("3")
division_10 = Division(A=lng_6, B=panel_98)
panel_99 = Panel("m2")
clean_6 = CleanTree(RemoveNulls=True, RemoveInvalid=True, RemoveEmpty=True, Tree=round_10.Nearest)
round_11 = Round(Number=division_10)  # -> Nearest, Floor, Ceiling
concat_18 = Concatenate(FragmentA=panel_34, FragmentB=panel_45)
item_5 = ListItem(List=pt, Index=round_11.Nearest, Wrap=True)
concat_19 = Concatenate(FragmentA=clean_6, FragmentB=panel_99)
define_object_attributes_15 = DefineObjectAttributes(Layer=concat_18)
define_text_object_7 = DefineTextObject(Text=concat_19, Plane=item_5, DimensionStyle=value_list_7, OutputType="Text")
group_11 = Group(Objects=define_text_object_7)
bake_modify_layer_7 = BakeModifyLayer(Layer=concat_18, Bake=and_4)
bake_objects_15 = BakeObjects(Geometry=group_11, Attributes=define_object_attributes_15, Bake=and_4)

panel_100 = Panel("::Legend")  # disabled
concat_20 = Concatenate(FragmentA=panel_37, FragmentB=panel_100)  # disabled
define_object_attributes_16 = DefineObjectAttributes(Layer=concat_20)  # disabled
bake_objects_16 = BakeObjects(Geometry=data_10, Attributes=define_object_attributes_16, Bake=False)  # disabled

lng_7 = ListLength(List=pt_2)  # disabled
round_12 = Round(Number=room_area_m2)  # -> Nearest, Floor, Ceiling; disabled
panel_101 = Panel("3")  # disabled
division_11 = Division(A=lng_7, B=panel_101)  # disabled
panel_102 = Panel("m2")  # disabled
clean_7 = CleanTree(RemoveNulls=True, RemoveInvalid=True, RemoveEmpty=True, Tree=round_12.Nearest)  # disabled
round_13 = Round(Number=division_11)  # -> Nearest, Floor, Ceiling; disabled
concat_21 = Concatenate(FragmentA=panel_35, FragmentB=panel_49)  # disabled
item_6 = ListItem(List=pt_2, Index=round_13.Nearest, Wrap=True)  # disabled
concat_22 = Concatenate(FragmentA=clean_7, FragmentB=panel_102)  # disabled
define_text_object_8 = DefineTextObject(Text=concat_22, Plane=item_6, DimensionStyle=value_list_8, OutputType="Text")  # disabled
define_object_attributes_17 = DefineObjectAttributes(Layer=concat_21)  # disabled
group_12 = Group(Objects=define_text_object_8)  # disabled
bake_modify_layer_8 = BakeModifyLayer(Layer=concat_21, Bake=and_8)  # disabled
bake_objects_17 = BakeObjects(Geometry=group_12, Attributes=define_object_attributes_17, Bake=and_8)  # disabled

lng_8 = ListLength(List=pt_3)  # disabled
round_14 = Round(Number=room_area_m2_2)  # -> Nearest, Floor, Ceiling; disabled
panel_103 = Panel("3")  # disabled
division_12 = Division(A=lng_8, B=panel_103)  # disabled
panel_104 = Panel("m2")  # disabled
clean_8 = CleanTree(RemoveNulls=True, RemoveInvalid=True, RemoveEmpty=True, Tree=round_14.Nearest)  # disabled
round_15 = Round(Number=division_12)  # -> Nearest, Floor, Ceiling; disabled
concat_23 = Concatenate(FragmentA=panel_37, FragmentB=panel_50)  # disabled
item_7 = ListItem(List=pt_3, Index=round_15.Nearest, Wrap=True)  # disabled
concat_24 = Concatenate(FragmentA=clean_8, FragmentB=panel_104)  # disabled
define_object_attributes_18 = DefineObjectAttributes(Layer=concat_23)  # disabled
define_text_object_9 = DefineTextObject(Text=concat_24, Plane=item_7, DimensionStyle=value_list_9, OutputType="Text")  # disabled
group_13 = Group(Objects=define_text_object_9)  # disabled
bake_modify_layer_9 = BakeModifyLayer(Layer=concat_23, Bake=and_7)  # disabled
bake_objects_18 = BakeObjects(Geometry=group_13, Attributes=define_object_attributes_18, Bake=and_7)  # disabled

# ----
# Capture Views
panel_105 = Panel("\02. Scripts")  # disabled
mappenavn = Panel("05. ViewCaptures")  # disabled
analysetyper = Panel("""Sollys
Daylight Factor
Daylight Autonomy
UDI
Window""")  # disabled
relpath = RelativePath(Path=mappenavn)  # disabled
rep_3 = ReplaceText(Text=relpath, Find=panel_105, RecursiveReplace=False)  # disabled
falsestart_3 = Ladybug_FalseStartToggle(False)  # disabled
panel_106 = Panel("\0")  # disabled
panel_107 = Panel(rep_3)  # disabled
panel_108 = Panel(".")  # disabled
panel_109 = Panel(" scen2   ")  # disabled
and_10 = GateAnd(B=falsestart_3)  # disabled
imageheight = Panel("800")  # disabled
view_width = Panel("1200")  # disabled
viewtype = Panel("Rendered")  # disabled
panel_110 = Panel("1")  # disabled

viewn_name = Panel("""nw
ne
sw
se
Perspective
Top""")  # disabled
vælg_analysetype = ItemSelector(analysetyper, {"Sollys", "Daylight Factor", "Daylight Autonomy", "UDI", "Window"}, selected="Window")  # disabled
concat_25 = Concatenate(FragmentA=vælg_analysetype, FragmentC=panel_109, FragmentB=item_selector)  # disabled

item_selector_2 = ItemSelector(viewn_name)  # disabled

mindex = MemberIndex(Set=analysetyper, Member=vælg_analysetype)  # -> expr("x+1", Index), Count; disabled
concat_26 = Concatenate(FragmentA=panel_107, FragmentB=panel_106, FragmentC=mindex.Index, FragmentD=panel_108, FragmentE=vælg_analysetype)  # disabled
captureview = Ladybug_CaptureView(
    fileName=concat_25,
    folder=concat_26,
    viewNames=item_selector_2,
    imageWidth=view_width,
    imageHeight=imageheight,
    displayMode=viewtype,
    capture=falsestart_3)  # -> Output; disabled; plug-in component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
panel_111 = Panel(captureview)  # disabled
viewer = Ladybug_ImageViewer(ImagePath_=captureview, _scale_=panel_110, DisableClickable=False, SaveImgWithCoords=False, scale=1)  # -> ImagePath, Colors, GIF; disabled
panel_112 = Panel(viewer.ImagePath)  # disabled

filename_2 = Panel(concat_25)  # disabled

# ----
# Visualization
lng_9 = ListLength(List=sunpath.hoys)
lng_10 = ListLength(List=sunpath.hoys)  # -> flatten(Length)
panel_113 = Panel(lng_10)

hours = Slider(3, range=0..10)
list_8 = ValueList({"Shadow Study Layout": 0, "Sun Study Layout": 1}, selected="Sun Study Layout")
eval_2 = Evaluate(F="(y/x)*100", x=lng_9, y=hours)
panel_114 = Panel(eval_2)

cluster_16 = Cluster_4(B=list_8, D=panel_113)
cluster_17 = Cluster_6(A_3=name_of_project, A_2=lng_9, A=panel_114, M=directsunhours.mesh, B=directsunhours.results)
panel_115 = Panel(cluster_17)

list_length = ListLength(List=cluster_16)

legendpar_4 = LBLegendParameters(min="0", max=panel_113, seg_count=list_length, colors=cluster_16, continuous_leg=Toggle(False), num_decimals="0")  # -> leg_par; plug-in component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
heatmap_4 = LBSpatialHeatmap(
    values=directsunhours.results,
    mesh=directsunhours.mesh,
    legend_par=legendpar_4,
    legend_title="Dagslystimer ved jævndøgn",
    global_title=panel_115)  # -> mesh, legend, title, colors, legend_par; plug-in component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
data_12 = Data([heatmap_4.legend, heatmap_4.title])  # disabled
col = Colour(heatmap_4.colors)  # disabled
mesh_4 = Mesh(heatmap_4.mesh)  # disabled

# ==== cluster GRIDDSEN17037
brep = ClusterInput()
brep_2 = Brep(brep)
crv = Curve(brep)
null = NullItem(Item=brep_2)  # -> NullFlags, InvalidFlags, Description
boundary = BoundarySurfaces(Edges=crv)
and = GateAnd(A=null.NullFlags, B=null.InvalidFlags)
cull = CullPattern(List=brep_2, CullPattern=invert(and))
cull_2 = CullPattern(List=boundary, CullPattern=and)
brep_3 = Brep([cull_2, cull])
dim = Dimensions(Surface=brep_3)  # -> UDimension, VDimension
min = Minimum(A=dim.UDimension, B=dim.VDimension)
max = Maximum(A=dim.UDimension, B=dim.VDimension)
larger = LargerThan(FirstNumber=max, SecondNumber=Slider(500, range=0..1000))  # -> LargerThan, OrEqualTo
xor = GateXor(A=Toggle(False), B=larger.LargerThan)
units = LBUnitConverter(values=min, from_u="mm", to_u="m")  # -> all_u, values; plug-in component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
units_2 = LBUnitConverter(values=max, from_u="mm", to_u="m")  # -> all_u, values; plug-in component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
cull_3 = CullPattern(List=max, CullPattern=invert(xor))
cull_4 = CullPattern(List=units_2.values, CullPattern=xor)
eval = Evaluate(F="0.2*5^log10(x)", x=units.values)
panel = Panel([cull_4, cull_3])
python = GhPythonScript(x=eval)  # -> out, a
# ---------- python: Python ----------
__author__ = "ibc"
__version__ = "2020.10.07"

import rhinoscriptsyntax as rs
import math

if x < 1000:
    a="m"
else:
    a="mm"
# ---------- end python ----------
concat = Concatenate(FragmentA=eval, FragmentB=python.a)
panel_2 = Panel(concat)
clean = CleanTree(RemoveNulls=True, RemoveInvalid=True, RemoveEmpty=True, Tree=panel)
eval_2 = Evaluate(F="0.2*5^log10(x)", x=clean)
python_2 = GhPythonScript(x=eval_2)  # -> out, a; same code as python
concat_2 = Concatenate(FragmentA=eval_2, FragmentB=python_2.a)
docunits = ConvertToDocumentUnits(ValueString=[concat_2, "500mm"])  # -> flatten(ValueInDocumentUnits)
panel_3 = Panel(docunits)
panel_4 = ClusterOutput(panel_3)

# ==== cluster Cluster
x = ClusterInput()
pt = ConstructPoint(XCoordinate=0, YCoordinate=0, ZCoordinate=0)
number_slider = Slider(50, range=0..100)
neg = Negative(Value=x)
circle = CircleCNR(Center=pt, Normal=Vector(0, 0, 1), Radius=1)
pt_2 = ClusterOutput(pt)
divide = DivideCurve(Curve=circle, Count=Slider(3600, range=0..10000), Kinks=False)  # -> Points, Tangents, Parameters
eval = Evaluate(F="x*10+900", x=neg)
item = ListItem(List=divide.Points, Index=eval, Wrap=True)
docunits = ConvertToDocumentUnits(ValueString="50m")
vec2pt = Vector2Pt(PointA=pt, PointB=item, Unitize=False)  # -> Vector, Length
amp = Amplitude(Vector=vec2pt.Vector, Amplitude=docunits)
V = ClusterOutput(amp)

# ==== cluster ForExplanationDobubleClickMe
# • The illuminance is less than 100 lux, i.e. UDI ‘fell-short’ (or UDI-f).
# • The illuminance is greater than 100 lux and less than 500 lux, i.e. UDI supplementary (or UDI-s).
# • The illuminance is greater than 500 lux and less than 2,500 lux, i.e. UDI autonomous
# (or UDI-a).
# • The illuminance is greater than 100 lux and less than 2,500 lux, i.e. UDI combined
# (or UDI-c).
# • The illuminance is greater than 2,500 lux, i.e. UDI exceeded (or UDI-e).
panel = Panel("""UDI-f
UDI-s
UDI-a
UDI-c
UDI-e""")

# ==== cluster Cluster_2
B = ClusterInput()
C = ClusterInput()
panel = Panel("""brep
surface
extrusion
mesh""")
concat = Concatenate(FragmentA="0_daylight::0_", FragmentB=B, FragmentD="_0.", FragmentC=graft(C))
panel_2 = Panel(concat)
txt = Text(concat)
panel_3 = Panel(txt)
dpipeline = DynamicGeometryPipeline(
    LayerFilter=graft(concat),
    TypeFilter=panel,
    NameFilter="*",
    GroupByLayer=False,
    GroupByType=False,
    IncludeHidden=True,
    IncludeLocked=True,
    enableFullPath=True,
    listenToAttributes=True)
panel_4 = Panel(""":
_""")
split = TextSplit(Text=panel_3, Separators=panel_4)
filterlay = FilterByLayer(Geometry=dpipeline, Layer=concat, OnlyVisible=True)
item = ListItem(List=split, Index=0, Wrap=True)  # -> Item2, Item1, Item, Item1_2
panel_5 = Panel(item.Item1)
panel_6 = Panel(item.Item2)
txt_2 = Text(panel_6)
txt_3 = Text(panel_5)
clean = CleanTree(RemoveNulls=True, RemoveInvalid=True, RemoveEmpty=True, Tree=filterlay)
txt_4 = ClusterOutput(txt_2)
txt_5 = ClusterOutput(txt_3)
T = ClusterOutput(clean)

# ==== cluster Cluster_3
B = ClusterInput()
B_2 = ClusterInput()
panel = Panel("""brep
surface
extrusion
mesh""")
concat = Concatenate(FragmentA="0_daylight::", FragmentB=B)
panel_2 = Panel(concat)
concat_2 = Concatenate(FragmentA="0_daylight::", FragmentB=B_2)
panel_3 = Panel(concat_2)
dpipeline = DynamicGeometryPipeline(
    LayerFilter=graft(concat_2),
    TypeFilter=panel,
    NameFilter="*",
    GroupByLayer=False,
    GroupByType=False,
    IncludeHidden=True,
    IncludeLocked=True,
    enableFullPath=True,
    listenToAttributes=True)  # -> flatten(GeometryOut)
dpipeline_2 = DynamicGeometryPipeline(
    LayerFilter=graft(concat),
    TypeFilter=panel,
    NameFilter="*",
    GroupByLayer=False,
    GroupByType=False,
    IncludeHidden=True,
    IncludeLocked=True,
    enableFullPath=True,
    listenToAttributes=True)
filterlay = FilterByLayer(Geometry=dpipeline_2, Layer=concat, OnlyVisible=True)
panel_4 = Panel(dpipeline)
debrep = DeconstructBrep(Brep=filterlay)  # -> Faces, Edges, Vertices
filterlay_2 = FilterByLayer(Geometry=dpipeline, Layer=concat_2, OnlyVisible=True)
clean = CleanTree(RemoveNulls=True, RemoveInvalid=True, RemoveEmpty=True, Tree=debrep.Faces)
T = ClusterOutput(clean)
G = ClusterOutput(filterlay_2)

# ==== cluster Cluster_4
D = ClusterInput()
range = Range(Domain=D, Steps=D)
panel = Panel(D)
bounds = Bounds(Numbers=range)
deconstruct_domain = DeconstructDomain(Domain=bounds)  # -> Start, End
B = ClusterInput()
gradient = Gradient(
    LowerLimit=deconstruct_domain.Start,
    UpperLimit=deconstruct_domain.End,
    Parameter=range,
    stops=[0: RGB(0, 0, 0), 1: RGB(255, 255, 255)])
gradient_2 = Gradient(
    LowerLimit=deconstruct_domain.Start,
    UpperLimit=deconstruct_domain.End,
    Parameter=range,
    stops=[0: RGB(0, 0, 255), 0.5: RGB(255, 0, 0), 1: RGB(255, 255, 0)])
xor = GateXor(A=Toggle(False), B=B)
cull = CullPattern(List=gradient, CullPattern=invert(xor))
cull_2 = CullPattern(List=gradient_2, CullPattern=xor)
panel_2 = Panel(gradient_2)
data = Data([cull, cull_2])
data_2 = ClusterOutput(data)
panel_3 = Panel(data)

# ==== cluster Cluster_6
number_slider = Slider(12, range=0..100)
A = ClusterInput()
panel = Panel(A)
A_2 = ClusterInput()

division = Division(A=A, B="100")
multiplication = Multiplication(A=A_2, B=division)
panel_2 = Panel(multiplication)
round = Round(Number=panel_2)  # -> Nearest, Floor, Ceiling
panel_3 = Panel(round.Nearest)

data = Data(A_2)
panel_4 = Panel(data)
B = ClusterInput()
M = ClusterInput()
panel_5 = Panel(B)
panel_6 = Panel(M)

# ----
# Udregner det vertikale areal, der overholder det valgte solskinstime antal.
larger = LargerThan(FirstNumber=round.Nearest, SecondNumber=flatten(B))  # -> LargerThan, OrEqualTo
cullf = CullFaces(Mesh=M, Pattern=larger.LargerThan)
facen = FaceNormals(Mesh=cullf)  # -> Centers, Normals
devec = DeconstructVector(Vector=facen.Normals)  # -> XComponent, YComponent, ZComponent
round_2 = Round(Number=devec.ZComponent)  # -> Nearest, Floor, Ceiling
equals = Equality(FirstNumber=round_2.Nearest, SecondNumber=Slider(0, range=0..100))  # -> Equality, Inequality
cullf_2 = CullFaces(Mesh=cullf, Pattern=equals.Inequality)
area = Area(Geometry=cullf_2)  # -> Area, Centroid
panel_7 = Panel(area.Area)

# ----
# Udregner totale vertikale areal af klimaskærm.
facen_2 = FaceNormals(Mesh=M)  # -> Centers, Normals
devec_2 = DeconstructVector(Vector=facen_2.Normals)  # -> XComponent, YComponent, ZComponent
round_3 = Round(Number=devec_2.ZComponent)  # -> Nearest, Floor, Ceiling
equals_2 = Equality(FirstNumber=round_3.Nearest, SecondNumber=Slider(0, range=0..100))  # -> Equality, Inequality
cullf_3 = CullFaces(Mesh=flatten(M), Pattern=flatten(equals_2.Inequality))
area_2 = Area(Geometry=cullf_3)  # -> Area, Centroid
panel_8 = Panel(area_2.Area)

A_3 = ClusterInput()
area_3 = Area(Geometry=M)  # -> Area, Centroid
panel_9 = Panel(area_3.Area)

# ----
# % del af facade, som opfylder
# solskinstimeantallet på facade
cluster = Cluster_5(A=panel_7, B=panel_8)
panel_10 = Panel(cluster)
panel_11 = Panel(panel_3)
panel_12 = Panel("%.")
concat = Concatenate(
    FragmentA=A_3,
    FragmentB=":",
    FragmentC=" ",
    FragmentD=panel_10,
    FragmentE="% of the facade recieves ",
    FragmentF=" ",
    FragmentG=panel_11,
    FragmentH=" ",
    FragmentL="or more",
    FragmentM=" ",
    FragmentI="hours of direct sunlight",
    FragmentJ=" ")

panel_13 = Panel(concat)
R = ClusterOutput(concat)

# ==== cluster Cluster_7
L = ClusterInput()
L_2 = ClusterInput()

# ----
# Model Unit Scaling
A = ClusterInput()
smaller = SmallerThan(FirstNumber=A, SecondNumber="850")  # -> SmallerThan, OrEqualTo
xor = GateXor(A=Toggle(False), B=smaller.OrEqualTo)
cull = CullPattern(List=L, CullPattern=invert(xor))
cull_2 = CullPattern(List=L_2, CullPattern=xor)

panel = Panel(A)
panel_2 = Panel([cull, cull_2])
L_3 = ClusterOutput(cull)
L_4 = ClusterOutput(cull_2)

# ==== cluster AnalysisGrid: Creates analysis grid for daylight simulations
falsestart = Ladybug_FalseStartToggle(False)
B = ClusterInput()
brep = ClusterInput()
panel = Panel(brep)
A = ClusterInput()
referencehøjde = Panel(A)
D = ClusterInput()
dist_from_base = Panel(D)
B_2 = ClusterInput()
dist_between_gridpoints = Panel(B_2)
xor = GateXor(A=falsestart, B=B)

# ----
# Curve or Brep ?
crv = Curve(brep)
brep_2 = Brep(brep)
null = NullItem(Item=brep_2)  # -> NullFlags, InvalidFlags, Description
boundary = BoundarySurfaces(Edges=crv)
and = GateAnd(A=null.NullFlags, B=null.InvalidFlags)
cull = CullPattern(List=brep_2, CullPattern=invert(and))
cull_2 = CullPattern(List=boundary, CullPattern=and)
brep_3 = Brep([cull_2, cull])

# ----
# Remove small areas < 5m2
panel_2 = Panel("2236mm")
panel_3 = Panel("1000mm")
docunits = ConvertToDocumentUnits(ValueString=panel_2)
multiplication = Multiplication(A=docunits, B=docunits)
area = Area(Geometry=brep_3)  # -> Area, Centroid
larger = LargerThan(FirstNumber=area.Area, SecondNumber=multiplication)  # -> LargerThan, OrEqualTo
panel_4 = Panel(larger.LargerThan)
cull_3 = CullPattern(List=brep_3, CullPattern=larger.LargerThan)

# ----
# Normals Controls
panel_5 = Panel("{0.5, 0.5, 0}")
evalsrf = EvaluateSurface(Surface=reparameterize(cull_3), Point=panel_5)  # -> Point, Normal, UDirection, VDirection, Frame
neg = Negative(Value=evalsrf.Normal)
untrim = Untrim(Surface=cull_3)
cull_4 = CullPattern(List=neg, CullPattern=invert(xor))
cull_5 = CullPattern(List=evalsrf.Normal, CullPattern=xor)
docunits_2 = ConvertToDocumentUnits(ValueString="-5000mm")
docunits_3 = ConvertToDocumentUnits(ValueString="5000mm")
area_2 = Area(Geometry=untrim)  # -> Area, Centroid
data = Data([cull_5, cull_4])
concat = Concatenate(FragmentA=docunits_2, FragmentB=" to ", FragmentC=docunits_3)
pl = PlaneNormal(Origin=area_2.Centroid, ZAxis=data)
rectangle = Rectangle(Plane=pl, XSize=concat, YSize=concat, Radius=0)  # -> Rectangle, Length
planesrf = PlaneSurface(Plane=pl, XSize=Domain(-10, 10), YSize=Domain(-10, 10))
boundary_2 = BoundarySurfaces(Edges=rectangle.Rectangle)

# ----
# Flipping/Moving Geometry
flip = Flip(Surface=cull_3, Guide=planesrf)  # -> Surface, Result
vec = Vector(pl)
debrep = DeconstructBrep(Brep=boundary_2)  # -> Faces, Edges, Vertices
amp = Amplitude(Vector=vec, Amplitude=A)
pline = PolyLine(Vertices=debrep.Vertices, Closed=True)
move = Move(Geometry=flip.Surface, Motion=amp)  # -> Geometry, Transform
debrep_2 = DeconstructBrep(Brep=move.Geometry)  # -> Faces, Edges, Vertices
flip_2 = FlipCurve(Curve=pline)  # -> Curve, Flag
join_curves = JoinCurves(Curves=debrep_2.Edges, Preserve=False)
flip_3 = FlipCurve(Curve=join_curves, Guide=flip_2.Curve)  # -> Curve, Flag

evalsrf_2 = EvaluateSurface(Surface=reparameterize(move.Geometry), Point="{0.5, 0.5, 0}")  # -> Point, Normal, UDirection, VDirection, Frame
docunits_4 = ConvertToDocumentUnits(ValueString="5000mm")
amp_2 = Amplitude(Vector=evalsrf_2.Normal, Amplitude=docunits_4)
vdisex = VectorDisplayEx(Point=evalsrf_2.Point, Vector=amp_2, Colour=RGB(0, 0, 0), Width=2)

prudecrv = PrudeCurve(Curve=flip_3.Curve, Length=0.1595272236, BlendType=0, Bulge=0.5)  # -> Prude, R
offcrv = OffsetCurve(Curve=flip_3.Curve, Plane=pl, Distance=D, BothSides=False, Kinks=0, CapType=1)
boundary_3 = BoundarySurfaces(Edges=offcrv)

# ----
# Remove small areas < 5m2
panel_6 = Panel("100mm")
area_3 = Area(Geometry=boundary_3)  # -> Area, Centroid
docunits_5 = ConvertToDocumentUnits(ValueString=panel_6)
multiplication_2 = Multiplication(A=docunits_5, B=docunits_5)
larger_2 = LargerThan(FirstNumber=area_3.Area, SecondNumber=multiplication_2)  # -> LargerThan, OrEqualTo
cull_6 = CullPattern(List=boundary_3, CullPattern=larger_2.LargerThan)
panel_7 = Panel(larger_2.LargerThan)
clean_tree = CleanTree(RemoveNulls=True, RemoveInvalid=True, RemoveEmpty=True, Tree=cull_6)

# ----
# Untrimming/Retrimmung and subdividing surface
untrim_2 = Untrim(Surface=clean_tree)
dim = Dimensions(Surface=untrim_2)  # -> UDimension, VDimension
division = Division(A=dim.UDimension, B=B_2)
division_2 = Division(A=dim.VDimension, B=B_2)
round = Round(Number=division_2)  # -> Nearest, Floor, Ceiling
round_2 = Round(Number=division)  # -> Nearest, Floor, Ceiling
graft = GraftTree(Tree=untrim_2, IncludeEmptyLists=True, IncludeNullItems=True)
divide = DivideDomain²(Domain=untrim_2, UCount=round_2.Nearest, VCount=round.Nearest)
subsrf = Isotrim(Surface=graft, Domain=divide)  # -> simplify(Surface)
graft_2 = GraftTree(Tree=clean_tree, IncludeEmptyLists=True, IncludeNullItems=True)
flip_4 = Flip(Surface=simplify(subsrf), Guide=graft(flip.Surface))  # -> Surface, Result
evalsrf_3 = EvaluateSurface(Surface=reparameterize(flip_4.Surface), Point="{0.5, 0.5, 0}")  # -> Point, Normal, UDirection, VDirection, Frame
incurve = PointInCurve(Point=evalsrf_3.Point, Curve=graft_2)  # -> Relationship, Point

# ---- group: surfaces for coloring!
cull_7 = CullPattern(List=flip_4.Surface, CullPattern=incurve.Relationship)

# ----
# Final Sorting
cull_8 = CullPattern(List=evalsrf_3.Point, CullPattern=incurve.Relationship)
cull_9 = CullPattern(List=evalsrf_3.Normal, CullPattern=incurve.Relationship)
number_slider = Slider(1, range=0..1)
wires = BrepWireframe(Brep=cull_7, Density=-1)
area_4 = Area(Geometry=cull_7)  # -> Area, Centroid
docunits_6 = ConvertToDocumentUnits(ValueString="5000mm")
amp_3 = Amplitude(Vector=cull_9, Amplitude=docunits_6)
mesh_uv = MeshSurface(Surface=cull_7, UCount=number_slider, VCount=number_slider, Overhang=True, Equalize=False)
mjoin = MeshJoin(Meshes=mesh_uv)
vdisex_2 = VectorDisplayEx(Point=cull_8, Vector=amp_3, Colour=RGB(0, 0, 0), Width=2)

docunits_7 = ConvertToDocumentUnits(ValueString="5000mm")
amp_4 = Amplitude(Vector=evalsrf_3.Normal, Amplitude=docunits_7)
vdisex_3 = VectorDisplayEx(Point=evalsrf_3.Point, Vector=amp_4, Colour=RGB(0, 0, 0), Width=2)

L = ClusterOutput(cull_8)
L_2 = ClusterOutput(cull_9)
A_2 = ClusterOutput(area_4.Area)
L_3 = ClusterOutput(cull_7)
M = ClusterOutput(mjoin)

# ==== cluster TopographyV10: Creates topographic surfaces from assigned point values along with height curves

# ----
# Analysis surface(s)
srf = ClusterInput()
srf_2 = Surface(srf)
join = BrepJoin(Breps=srf_2)  # -> Breps, Closed
fmerge = MergeFaces(Brep=join.Breps)  # -> Breps, Before, After
flip = Flip(Surface=fmerge.Breps)  # -> Surface, Result

falsestart = Ladybug_FalseStartToggle(False)
falsestart_2 = Ladybug_FalseStartToggle(False)
wiredisplay = ControlWireDisplay(WireDisplay=Slider(0, range=0..2))
hideshow = HideShowObjectPreview(Visible=falsestart)
onoff = EnableDisableObject(Enabled=falsestart_2)

# ----
# Flip Normals ?
falsestart_3 = Ladybug_FalseStartToggle(False)
bool = Boolean(True)
xor = GateXor(A=falsestart_3, B=bool)

B = ClusterInput()

# ----
# Results
results = ClusterInput()
results_2 = Number(simplify(results))

# ----
# Analysis points
pt = ClusterInput()
pt_2 = Point(pt)

static_dynamic = Panel(B)

# ----
# Normal Control
panel = Panel("{0.5,0.5,0}")
evalsrf = EvaluateSurface(Surface=reparameterize(flip.Surface), Point=panel)  # -> Point, Normal, UDirection, VDirection, Frame
neg = Negative(Value=evalsrf.Normal)
cull = CullPattern(List=neg, CullPattern=invert(xor))
cull_2 = CullPattern(List=evalsrf.Normal, CullPattern=xor)
docunits = ConvertToDocumentUnits(ValueString="1000mm")
data = Data([cull_2, cull])
amp = Amplitude(Vector=evalsrf.Normal, Amplitude=docunits)
vdisex = VectorDisplayEx(Point=pt_2, Vector=amp, Colour=RGB(0, 0, 0), Width=2)

# ----
# Create Plane Orientation
panel_2 = Panel("5000mm")
untrim = Untrim(Surface=flip.Surface)
area = Area(Geometry=untrim)  # -> Area, Centroid
docunits_2 = ConvertToDocumentUnits(ValueString="-5000mm")
docunits_3 = ConvertToDocumentUnits(ValueString=panel_2)
concat = Concatenate(FragmentA=docunits_2, FragmentB=" to ", FragmentC=docunits_3)
pl = PlaneNormal(Origin=area.Centroid, ZAxis=data)
planesrf = PlaneSurface(Plane=pl, XSize=Domain(-10, 10), YSize=Domain(-10, 10))
rectangle = Rectangle(Plane=pl, XSize=concat, YSize=concat, Radius=0)  # -> Rectangle, Length

debrep = DeconstructBrep(Brep=fmerge.Breps)  # -> simplify(Faces), Edges, simplify(Vertices)
crv = Curve(rectangle.Rectangle)
join_2 = JoinCurves(Curves=debrep.Edges, Preserve=True)  # -> simplify(Curves)
list = ItemSelector(crv, {"Polyline Curve"}, selected="Polyline Curve")
crv_2 = Curve(join_2)
flip_2 = FlipCurve(Curve=crv_2, Guide=list)  # -> Curve, Flag

results_3 = Panel(results_2)
bnd = Bounds(Numbers=results_3)
result_domain = Panel(bnd)

# ----
# Scaling values to geometric value
panel_3 = Panel("1")
pcent = Percentage(Number=results_2, Percent="1000")
xor_2 = GateXor(A=Toggle(False), B=B)
cull_3 = CullPattern(List=pcent, CullPattern=xor_2)

panel_4 = Panel("""0
100""")
pcent_2 = Percentage(Number="1000", Percent=panel_4)
pcent_3 = Percentage(Number=panel_4, Percent=panel_3)
cull_4 = CullPattern(List=pcent_3, CullPattern=invert(xor_2))
cull_5 = CullPattern(List=pcent_2, CullPattern=xor_2)
panel_5 = Panel([cull_4, cull_5])
clean = CleanTree(RemoveNulls=True, RemoveInvalid=True, RemoveEmpty=True, Tree=panel_5)

pcent_4 = Percentage(Number=results_2, Percent=panel_3)

cull_6 = CullPattern(List=pcent_4, CullPattern=invert(xor_2))
panel_6 = Panel([cull_3, cull_6])
clean_2 = CleanTree(RemoveNulls=True, RemoveInvalid=True, RemoveEmpty=True, Tree=panel_6)

# ----
# Interpolate edges
cps = ClosestPoints(Point=debrep.Vertices, Cloud=pt_2, Count=1)  # -> ClosestPoint, CPIndex, Distance
item = ListItem(List=clean_2, Index=cps.CPIndex, Wrap=True)
amp_2 = Amplitude(Vector=evalsrf.Normal, Amplitude=flatten(item))
move = Move(Geometry=debrep.Vertices, Motion=amp_2)  # -> Geometry, Transform

# ----
# Scale points to result value
amp_3 = Amplitude(Vector=evalsrf.Normal, Amplitude=clean_2)
move_2 = Move(Geometry=pt_2, Motion=amp_3)  # -> Geometry, Transform

# ----
# Make Result Topography
pt_3 = Point(flatten([move_2.Geometry, move.Geometry]))
patch = Patch(Points=pt_3, Spans=Slider(30, range=0..100), Flexibility=Slider(30, range=0..100), Trim=True)

# ---- group: Safetynet #1
# Trim topo to analysis area
project = Project(Curve=flip_2.Curve, Brep=simplify(patch), Direction=data)  # -> simplify(Curve)
srfsplit = SurfaceSplit(Surface=patch, Curves=project)
debrep_2 = DeconstructBrep(Brep=srfsplit)  # -> Faces, Edges, Vertices
join_3 = JoinCurves(Curves=debrep_2.Edges, Preserve=False)
lng = ListLength(List=join_3)
larger = LargerThan(FirstNumber="1", SecondNumber=lng)  # -> LargerThan, OrEqualTo
cull_7 = CullPattern(List=simplify(srfsplit), CullPattern=flatten(larger.OrEqualTo))

# ---- group: SafetyNet#2
area_2 = Area(Geometry=flip.Surface)  # -> Area, Centroid
area_3 = Area(Geometry=cull_7)  # -> Area, Centroid
cp = ClosestPoint(Point=area_2.Centroid, Cloud=area_3.Centroid)  # -> ClosestPoint, CPIndex, Distance
list_2 = ItemSelector(cp.CPIndex, {"0"}, selected="0")
item_2 = ListItem(List=cull_7, Index=list_2, Wrap=True)

# ----
evalsrf_2 = EvaluateSurface(Surface=reparameterize(item_2), Point="{0.5,0.5,0}")  # -> Point, Normal, UDirection, VDirection, Frame
docunits_4 = ConvertToDocumentUnits(ValueString="200mm")
pt_4 = Point(evalsrf_2.Point)

max_min_result_vector = Panel(panel_5)
bnd_2 = Bounds(Numbers=max_min_result_vector)
max_min_result_vector_domain = Panel(bnd_2)

result_vector = Panel(panel_6)
bnd_3 = Bounds(Numbers=result_vector)
result_vector_domain = Panel(bnd_3)

# ----
# Genererer konturkurver
srf_3 = Surface(item_2)
contour = Contour(Shape=simplify(srf_3), Point=pt_4, Direction=pl, Distance=docunits_4)
debrep_3 = DeconstructBrep(Brep=srf_3)  # -> Faces, Edges, Vertices
join_4 = JoinCurves(Curves=debrep_3.Edges, Preserve=False)  # -> flatten(Curves)
trim = TrimWithRegions(Curve=simplify(contour), Regions=simplify(join_4))  # -> simplify(graft(Inside)), Outside
path_mapper = PathMapper(trim.Inside, source="{A;B;C;D}", target="{A}")
path_mapper_2 = PathMapper(trim.Inside, source="{A;B;C}", target="{A}")
path_mapper_3 = PathMapper(trim.Inside, source="{A;B}", target="{A}")

path_mapper_4 = PathMapper(trim.Inside, source="{A}", target="{0}")
path_mapper_5 = PathMapper(trim.Inside, source="{A}", target="{A}")

crv_3 = Curve(path_mapper_4)
clean_3 = CleanTree(RemoveNulls=True, RemoveInvalid=True, RemoveEmpty=True, Tree=crv_3)
crv_4 = Curve(clean_3)

# ----
# Remapping Values
mesh = MeshBrep(
    Brep=item_2,
    Settings={GridMaxCount=0, GridMinCount=16, JaggedSeams=True, MaxEdgeLength=2000, MinEdgeLength=700, MinTolerance=0, Refine=True, RefineAngle=0, RelativeTolerance=0.65, SimplePlanes=False, Tolerance=0})  # -> simplify(Mesh)
demesh = DeconstructMesh(Mesh=mesh)  # -> Vertices, Faces, Colours, Normals

project_2 = Project(Geometry=demesh.Vertices, Plane=pl)  # -> Geometry, Transform
dist = Distance(PointA=project_2.Geometry, PointB=demesh.Vertices)

mesh_points = Panel(dist)
bnd_4 = Bounds(Numbers=mesh_points)
mesh_points_domain = Panel(bnd_4)

panel_7 = Panel(dist)

remap = RemapNumbers(Value=dist, Source=max_min_result_vector_domain, Target="0 to 100")  # -> Mapped, Clipped
panel_8 = Panel(remap.Clipped)
panel_9 = Panel(remap.Mapped)

remapped_number = Panel(remap.Clipped)
bnd_5 = Bounds(Numbers=remapped_number)
remapped_domain = Panel(bnd_5)

# ----
# Colors sorted for legend
sort = SortList(Keys=remap.Clipped, ValuesA=remap.Clipped)  # -> Keys, ValuesA
panel_10 = Panel(sort.ValuesA)
gradient = Gradient(
    LowerLimit="0",
    UpperLimit="100",
    Parameter=sort.ValuesA,
    stops=[0: RGB(94, 120, 145), 0.38: RGB(167, 209, 82), 0.615: RGB(255, 210, 87), 1: RGB(255, 250, 204)])
gradient_2 = Gradient(
    LowerLimit="0",
    UpperLimit="100",
    Parameter=sort.ValuesA,
    stops=[0: RGB(0, 255, 255), 0.461: RGB(255, 255, 0), 1: RGB(255, 0, 0)])

bnd_6 = Bounds(Numbers=results_2)
dedomain = DeconstructDomain(Domain=bnd_6)  # -> Start, End
smaller = SmallerThan(FirstNumber=dedomain.End, SecondNumber="25")  # -> SmallerThan, OrEqualTo
xor_3 = GateXor(A=Toggle(False), B=smaller.OrEqualTo)
cull_8 = CullPattern(List=gradient_2, CullPattern=invert(xor_3))
cull_9 = CullPattern(List=gradient, CullPattern=xor_3)
data_2 = Data([cull_8, cull_9])

# ----
# IsoCurve and Gradient mesh
panel_11 = Panel("0")
gradient_3 = Gradient(
    LowerLimit=panel_11,
    UpperLimit="100",
    Parameter=remap.Clipped,
    stops=[0: RGB(94, 120, 145), 0.38: RGB(167, 209, 82), 0.615: RGB(255, 210, 87), 1: RGB(255, 250, 204)])
gradient_4 = Gradient(
    LowerLimit=panel_11,
    UpperLimit="100",
    Parameter=remap.Clipped,
    stops=[0: RGB(0, 255, 255), 0.461: RGB(255, 255, 0), 1: RGB(255, 0, 0)])

bnd_7 = Bounds(Numbers=results_2)
dedomain_2 = DeconstructDomain(Domain=bnd_7)  # -> Start, End
smaller_2 = SmallerThan(FirstNumber=dedomain_2.End, SecondNumber="25")  # -> SmallerThan, OrEqualTo
xor_4 = GateXor(A=Toggle(False), B=smaller_2.OrEqualTo)
cull_10 = CullPattern(List=gradient_4, CullPattern=invert(xor_4))
cull_11 = CullPattern(List=gradient_3, CullPattern=xor_4)
data_3 = Data([cull_10, cull_11])
conmesh = ConstructMesh(Vertices=demesh.Vertices, Faces=demesh.Faces, Colours=data_3)  # -> simplify(Mesh)

remapped_numbers = Number(remap.Clipped)
vertices = Point(demesh.Vertices)
crv_5 = Curve(crv_4)
face = MeshFace(demesh.Faces)
pln = Plane(pl)
colors = Data(data_2)
mesh_2 = Mesh(conmesh)
remapped_numbers_2 = ClusterOutput(remapped_numbers)
pln_2 = ClusterOutput(pln)
colors_2 = ClusterOutput(colors)
mesh_3 = ClusterOutput(mesh_2)
crv_6 = ClusterOutput(crv_5)
face_2 = ClusterOutput(face)
vertices_2 = ClusterOutput(vertices)

# ==== cluster Cluster_8
breps = ClusterInput()

# ---- group: Sort vertical from horizontal faces
breps_2 = Brep(breps)
debrep = DeconstructBrep(Brep=breps_2)  # -> Faces, Edges, Vertices
control_difference_between_incline_of_ho = Slider(0.1, range=0..0.1)  # "control difference between incline of horizontal and vertical faces"
evalsrf = EvaluateSurface(Surface=reparameterize(debrep.Faces), Point="{0.5,0.5,0}")  # -> Point, Normal, UDirection, VDirection, Frame
devec = DeconstructVector(Vector=evalsrf.Normal)  # -> XComponent, YComponent, ZComponent
sqr = Square(Value=devec.ZComponent)
sqrt = SquareRoot(Value=sqr)
larger = LargerThan(FirstNumber=control_difference_between_incline_of_ho, SecondNumber=sqrt)  # -> LargerThan, OrEqualTo
cull = CullPattern(List=debrep.Faces, CullPattern=larger.LargerThan)
area = Area(Geometry=cull)  # -> Area, Centroid
sort = SortList(Keys=area.Area, ValuesA=cull)  # -> Keys, reverse(ValuesA)

# ----
boxprop = BoxProperties(Box=breps_2)  # -> Center, Diagonal, Area, Volume, Degeneracy
amp = Amplitude(Vector=boxprop.Diagonal, Amplitude=Slider(1000, range=0..1000))
vdisex = VectorDisplayEx(Point=boxprop.Center, Vector=amp, Colour=RGB(0, 0, 0), Width=2)

panel = Panel(sqrt)
i = ClusterInput()

# ---- group: Get one of (mostly) two equally sized faces in window geometry (brep)
largestface = Panel("""0
1""")
item = ListItem(List=sort.ValuesA, Index=largestface, Wrap=True)
evalsrf_2 = EvaluateSurface(Surface=reparameterize(item), Point="{0.5,0.5,0}")  # -> Point, Normal, UDirection, VDirection, Frame
item_2 = ListItem(List=flatten(evalsrf_2.Normal), Index=i, Wrap=True)
dprod = DotProduct(VectorA=evalsrf_2.Normal, VectorB=item_2, Unitize=False)
dprod_2 = DotProduct(VectorA=item_2, VectorB=item_2, Unitize=False)
round = Round(Number=dprod)  # -> Nearest, Floor, Ceiling
round_2 = Round(Number=dprod_2)  # -> Nearest, Floor, Ceiling
equals = Equality(FirstNumber=round_2.Nearest, SecondNumber=round.Nearest)  # -> Equality, Inequality
cull_2 = CullPattern(List=item, CullPattern=equals.Equality)

# ----
amp_2 = Amplitude(Vector=evalsrf_2.Normal, Amplitude=Slider(1000, range=0..1000))
vdisex_2 = VectorDisplayEx(Point=evalsrf_2.Point, Vector=amp_2, Colour=RGB(0, 0, 0), Width=2)

panel_2 = Panel(round.Nearest)
panel_3 = Panel(dprod)
L = ClusterOutput(cull_2)

# ==== cluster Cluster_9

# ---- group: Brep
zone = ClusterInput()

# ----
zone_2 = Data(zone)
debrep = DeconstructBrep(Brep=zone_2)  # -> simplify(Faces), Edges, Vertices
evalsrf = EvaluateSurface(Surface=reparameterize(debrep.Faces), Point="{0.5,0.5,0}")  # -> Point, Normal, UDirection, VDirection, Frame
devec = DeconstructVector(Vector=evalsrf.Normal)  # -> XComponent, YComponent, ZComponent
pdecon = Deconstruct(Point=evalsrf.Point)  # -> XComponent, YComponent, ZComponent
sqr = Square(Value=devec.ZComponent)
sqrt = SquareRoot(Value=sqr)
sort = SortList(Keys=pdecon.ZComponent, ValuesA=debrep.Faces)  # -> Keys, ValuesA
larger = LargerThan(FirstNumber=Slider(0.1, range=0..0.1), SecondNumber=sqrt)  # -> LargerThan, OrEqualTo
item = ListItem(List=sort.ValuesA, Index=0, Wrap=True)  # -> Item1, Item
panel = Panel(sqrt)
ceiling = Data(item.Item)
floor = Data(item.Item1)
cull = CullPattern(List=debrep.Faces, CullPattern=larger.LargerThan)

# ---- group: Item -1
floor_2 = ClusterOutput(floor)

# ---- group: Item
ceiling_2 = ClusterOutput(ceiling)

# ----
walls = Data(cull)

# ---- group: List
walls_2 = ClusterOutput(walls)

# ==== cluster CreatesSimLayers

# ----
# Controls
number_slider = Slider(1, range=0..2)
panel = Panel("""0_window_0.60:10,255,255
0_window_0.65:10,225,255
0_window_0.70:10,235,255
0_window_0.72:10,245,255
0_window_0.88:10,255,255
0_wall_0.50:white
0_sensor:pink
0_ceiling_0.70:orange
0_context_0.20:150,150,150
0_floor_0.20:white
0_frames_0.70:red
0_terrain_0.10:green
0_ground_0.10:green""")
bool = ClusterInput()
bool_2 = Boolean(invert(bool))
wiredisplay = ControlWireDisplay(WireDisplay=number_slider)
xor = GateXor(A=Toggle(False), B=bool_2)

# ----
# Delete Initial Layers
# 0_layer
panel_2 = Panel("Layer 0")
series = Series(Start=1, Step=1, Count=6)
concat = Concatenate(FragmentA=panel_2, FragmentB=series)
lt_table = LinetypeTable(Update=True)  # -> Linetypes, LinetypePattern
list = ItemSelector(lt_table.Linetypes, {"Hidden", "Dashed", "DashDot", "Center", "Border", "Dots"}, selected="DashDot")
cull = CullPattern(List=concat, CullPattern=xor)
layers = CreateModifyLayers(LayerName=cull, DeleteLayer=Toggle(True), enableFullPath=True)  # -> LayerNames, LayerFullPath
cull_2 = CullPattern(List="0", CullPattern=xor)
layers_2 = CreateModifyLayers(LayerName=cull_2, LayerLinetype=graft(list), DeleteLayer=False, enableFullPath=True)  # -> LayerNames, LayerFullPath

# ----
# Separate Text
panel_3 = Panel(":")
split = TextSplit(Text=panel, Separators=panel_3)  # -> simplify(Result)
item = ListItem(List=split, Index=0, Wrap=True)  # -> Item, Item1
name = Text(item.Item)
split_2 = TextSplit(Text=name, Separators="_")  # -> simplify(Result)
panel_4 = Panel(split_2)
item_2 = ListItem(List=split_2, Index=0, Wrap=True)  # -> Item, Item1, Item2
number = Panel(item_2.Item)
name_2 = Panel(item_2.Item1)
reflectance = Panel(item_2.Item2)

# ----
# Clipping plane layer
panel_5 = Panel("0_ClippingPlanes")
boolean = Boolean(xor)
docunits = ConvertToDocumentUnits(ValueString="10000mm")
cull_3 = CullPattern(List=panel_5, CullPattern=xor)
layers_3 = CreateModifyLayers(LayerName=cull_3, LayerColor=ColourSwatch(SwatchColor=RGB(0, 0, 0)), DeleteLayer=False, enableFullPath=True)  # -> LayerNames, LayerFullPath
python = GhPythonScript(x=docunits, y=docunits, bool=boolean, z=layers_3.LayerNames)  # -> out, i, j, k
# ---------- python: Python ----------
__author__ = "ibc"
__version__ = "2020.10.07"

import rhinoscriptsyntax as rs

import rhinoscriptsyntax as rs
import scriptcontext as sc
import Rhino

name=z
if bool==True:
    #sc.doc = Rhino.RhinoDoc.ActiveDoc
    layertable = sc.doc.Layers
    layerindex = layertable.Find(str(name),True)
    i=rs.AddClippingPlane(rs.WorldXYPlane(),x,y)
    j=rs.AddClippingPlane(rs.WorldYZPlane(),x,y)
    k=rs.AddClippingPlane(rs.WorldZXPlane(),x,y)


#print(sc.doc)
# ---------- end python ----------
createatts = CreateAttributes(Name=panel_5, LayerName=layers_3.LayerFullPath, enableFullPath=True)
geo = Geometry([python.i, python.j, python.k])
bake_geometry = BakeGeometry(Bake=xor, Geometry=geo, Attributes=createatts, DeleteOldBakes=False, PreserveTrees=False)

falsestart = Ladybug_FalseStartToggle(False)
tmatch = MatchText(Text=item_2.Item1, Pattern="*window*", Case=falsestart)

# ----
# Create Colors
panel_6 = Panel("1")
col = Colour(item.Item1)
gradient = Gradient(
    LowerLimit=panel_6,
    UpperLimit="0",
    Parameter=item_2.Item2,
    stops=[0: RGB(192, 255, 255), 0.501: RGB(181, 228, 255), 1: RGB(0, 3, 102)])
panel_7 = Panel(col)
cull_4 = CullPattern(List=gradient, CullPattern=tmatch)
cull_5 = CullPattern(List=panel_7, CullPattern=invert(tmatch))
panel_8 = Panel(cull_4)
panel_9 = Panel(cull_5)
col_2 = Colour([cull_4, cull_5])
panel_10 = Panel(col_2)

# ---- group: Materials
ahsv = SplitAHSV(Colour=panel_7)  # -> Alpha, Hue, Saturation, Value
expression = Expression(x=ahsv.Saturation, y="7", Expression="(x/y)")
colour_hsv = ColourHSV(Alpha=ahsv.Alpha, Hue=ahsv.Hue, Saturation=expression, Value=ahsv.Value)

# ----
# Naming layers
cull_6 = CullPattern(List=name, CullPattern=xor)
txt_layer = Text(cull_6)
expression_2 = Expression(x=txt_layer, Expression="Format(\"0_daylight::{0}\", x)")
lng = ListLength(List=txt_layer)
cull_7 = CullPattern(List=expression_2, CullPattern=lng)

# ----
# Baking Layers
panel_11 = Panel("""1
0.75""")
cull_8 = CullPattern(List=cull_7, CullPattern=xor)
cull_9 = CullPattern(List=col_2, CullPattern=xor)
item_3 = ListItem(List=panel_11, Index=tmatch, Wrap=True)
materials = CreateModifyMaterials(Name=cull_6, Diffuse=colour_hsv, Alpha=item_3)
panel_12 = Panel(cull_9)
layers_4 = CreateModifyLayers(LayerName=cull_8, LayerColor=cull_9, LayerMaterial=materials, DeleteLayer=False, enableFullPath=True)  # -> LayerNames, LayerFullPath

layer_table = LayerTable(Update=True, AutoUpdate=Toggle(True))  # -> Layers, FullLayerPaths, LayerColors, Linetypes, MaterialNames, Visible, PrintWidth, PrintColor
panel_13 = Panel(layers_4.LayerNames)
full_layer_paths = ClusterOutput(layer_table.FullLayerPaths)
panel_14 = Panel(layer_table.FullLayerPaths)
panel_15 = Panel(layers_4.LayerFullPath)

# ==== cluster Cluster_5
A = ClusterInput()
B = ClusterInput()
division = Division(A=A, B=B)
multiplication = Multiplication(A=division, B=Slider(100, range=0..100))
round = Round(Number=multiplication)  # -> Nearest, Floor, Ceiling
C = ClusterOutput(round.Ceiling)
